# Dynamo graph Заполнение кодификатора без деления (фильтрация типов в пайтоне).dyn (Dynamo 2.12.0.5650)

нижний_уровень_нуля = Levels("L01")  # graph input
отступ_нижнего_уровня_offset = DoubleInput(0)  # graph input
верхний_уровень_нуля = Levels("L01")  # graph input
отступ_от_верхнего_уровня_нуля = DoubleInput(0)  # graph input
значение_параметра_fam_undegrond = StringInput("Надземная часть")  # "Значение параметра FAM_Undegrond для элементом выше нуля"; graph input
значение_параметра_fam_undegrond_2 = StringInput("Подземная часть")  # "Значение параметра FAM_Undegrond для элементом ниже нуля"; graph input
исключить_указанные_id_вводить = StringInput("")  # "Исключить указанные ID (вводить через запятую)"; graph input

# group: Ввод данных
code_block = CodeBlock(zeroLowLevel=нижний_уровень_нуля, zeroLowLevelOff=отступ_нижнего_уровня_offset, zeroHighLevel=верхний_уровень_нуля, zeroHighLevelOff=отступ_от_верхнего_уровня_нуля, text_FAM_UndergroundUP=значение_параметра_fam_undegrond, text_FAM_UndergroundDOWN=значение_параметра_fam_undegrond_2, idsToExcept=исключить_указанные_id_вводить)
# ---------- code_block.designscript (7 lines) ----------
zeroLowLevel;
zeroLowLevelOff;
zeroHighLevel;
zeroHighLevelOff;
text_FAM_UndergroundUP;
text_FAM_UndergroundDOWN;
idsToExcept;
# ----------------------------------------
code_block_2 = CodeBlock(text_FAM_UndergroundUP=code_block.text_FAM_UndergroundUP, text_FAM_UndergroundDOWN=code_block.text_FAM_UndergroundDOWN, idsToExcept=code_block.idsToExcept) { text_FAM_UndergroundUP; text_FAM_UndergroundDOWN; idsToExcept; }
code_block_3 = CodeBlock(text_FAM_UndergroundUP=code_block_2.text_FAM_UndergroundUP, text_FAM_UndergroundDOWN=code_block_2.text_FAM_UndergroundDOWN) { text_FAM_UndergroundUP; text_FAM_UndergroundDOWN; }
code_block_4 = CodeBlock(text_FAM_UndergroundUP=code_block_3.text_FAM_UndergroundUP, text_FAM_UndergroundDOWN=code_block_3.text_FAM_UndergroundDOWN) { text_FAM_UndergroundUP; text_FAM_UndergroundDOWN; }

base_constraint = CodeBlock { "WALL_BASE_CONSTRAINT"; }
builtinparameter_name_to = Python(IN[0]=base_constraint)  # "BuiltInParameter Name to Parameter Name"; IronPython2
# ---------- builtinparameter_name_to.python (21 lines) ----------
import clr
import System
clr.AddReference('RevitAPI')
clr.AddReference('RevitAPIUI')
from Autodesk.Revit.DB import *
import Autodesk

PName = IN[0]

bips = System.Enum.GetValues(BuiltInParameter)
for bip in bips:
  try:
    parNames = LabelUtils.GetLabelFor(bip)
    if PName == bip.ToString():
      parName = parNames
  except:
    pass
try:
  OUT = parName
except: 
  OUT = "Такой херни в базе нету)"
# ----------------------------------------
top_constraint = CodeBlock { "WALL_HEIGHT_TYPE"; }
builtinparameter_name_to_2 = Python(IN[0]=top_constraint)  # "BuiltInParameter Name to Parameter Name"; IronPython2; same code as builtinparameter_name_to
base_offset = CodeBlock { "WALL_BASE_OFFSET"; }
builtinparameter_name_to_3 = Python(IN[0]=base_offset)  # "BuiltInParameter Name to Parameter Name"; IronPython2; same code as builtinparameter_name_to
top_offset = CodeBlock { "WALL_TOP_OFFSET"; }
builtinparameter_name_to_4 = Python(IN[0]=top_offset)  # "BuiltInParameter Name to Parameter Name"; IronPython2; same code as builtinparameter_name_to
unconnected_height = CodeBlock { "WALL_USER_HEIGHT_PARAM"; }
builtinparameter_name_to_5 = Python(IN[0]=unconnected_height)  # "BuiltInParameter Name to Parameter Name"; IronPython2; same code as builtinparameter_name_to
level = CodeBlock { "LEVEL_PARAM"; }
builtinparameter_name_to_6 = Python(IN[0]=level)  # "BuiltInParameter Name to Parameter Name"; IronPython2; same code as builtinparameter_name_to
height_offset_from_level = CodeBlock { "FLOOR_HEIGHTABOVELEVEL_PARAM"; }
builtinparameter_name_to_7 = Python(IN[0]=height_offset_from_level)  # "BuiltInParameter Name to Parameter Name"; IronPython2; same code as builtinparameter_name_to
шина_имени_параметров = CodeBlock(Base_Level_Param_Name=builtinparameter_name_to, Top_Level_Param_Name=builtinparameter_name_to_2, Base_Level_Offset_Param_Name=builtinparameter_name_to_3, Top_Level_Offset_Param_Name=builtinparameter_name_to_4, Unconnected_Height_Param_Name=builtinparameter_name_to_5, Level_Param_Name=builtinparameter_name_to_6, Height_Offset_From_Level_Param_Name=builtinparameter_name_to_7)
# ---------- шина_имени_параметров.designscript (7 lines) ----------
Base_Level_Param_Name;
Top_Level_Param_Name;
Base_Level_Offset_Param_Name;
Top_Level_Offset_Param_Name;
Unconnected_Height_Param_Name;
Level_Param_Name;
Height_Offset_From_Level_Param_Name;
# ----------------------------------------
all_elements_in_active_view = ElementsInView()
code_block_5 = CodeBlock(elements=all_elements_in_active_view)
# ---------- code_block_5.designscript (5 lines) ----------
elementTypes = Element.ElementType(elements);
bool1 = DSCore.Object.IsNull(Parameter.ParameterByName(elementTypes, "FAM_Underground"));
bool2 = DSCore.Object.IsNull(Parameter.ParameterByName(elements, "FAM_Underground"));
filter = List.FilterByBoolMask(elements, (bool1 && bool2));
FAM_Undeground_Exists = Dictionary.ValueAtKey(filter, "out");
# ----------------------------------------
python_script = Python(IN[0]=code_block_5.FAM_Undeground_Exists)  # IronPython2
# ---------- python_script.python (42 lines) ----------
# Made by Gavin Crump
# Free for use
# BIM Guru, www.bimguru.com.au

# Boilerplate text
import clr

clr.AddReference("RevitServices")
import RevitServices
from RevitServices.Persistence import DocumentManager 

clr.AddReference("RevitAPI")
import Autodesk 
from Autodesk.Revit.DB import *

# Current doc/app/ui
doc = DocumentManager.Instance.CurrentDBDocument

# Define list/unwrap list functions
def uwlist(input):
    result = input if isinstance(input, list) else [input]
    return UnwrapElement(result)

# Preparing input from dynamo to revit
items  = uwlist(IN[0])

itemgroup, hasgroup = [], []
	
# Get group and check if has group	
for i in items:
	if hasattr(i, "GroupId"):
		grp = i.Document.GetElement(i.GroupId)
		itemgroup.append(grp)
		if grp:
			hasgroup.append(True)
		else:
			hasgroup.append(False)
	else:
		itemgroup.append(None)

# Preparing output to Dynamo
OUT = [itemgroup, hasgroup]
# ----------------------------------------
code_block_6 = CodeBlock(p=python_script) { isInGroup=p[1]; }
filterByBoolMask = List.FilterByBoolMask(list=code_block_5.FAM_Undeground_Exists, mask=code_block_6)
code_block_7 = CodeBlock(elements=filterByBoolMask.out)
# ---------- code_block_7.designscript (15 lines) ----------
bool1 = elements.GetCategory.Name == Category.ByName("OST_Walls").Name;
bool2 = elements.GetCategory.Name == Category.ByName("OST_Floors").Name;
bool3 = elements.GetCategory.Name == Category.ByName("OST_StructuralFraming").Name;
bool4 = elements.GetCategory.Name == Category.ByName("OST_StructuralColumns").Name;
bool5 = elements.GetCategory.Name == Category.ByName("OST_GenericModel").Name;
bool6 = elements.GetCategory.Name == Category.ByName("OST_EdgeSlab").Name;
bool7 = elements.GetCategory.Name == Category.ByName("OST_StructuralFoundation").Name;

walls = List.FilterByBoolMask(elements, bool1)["in"];
floors = List.FilterByBoolMask(elements, bool2)["in"];
structuralFraming = List.FilterByBoolMask(elements, bool3)["in"];
structuralColumns = List.FilterByBoolMask(elements, bool4)["in"];
genericModel = List.FilterByBoolMask(elements, bool5)["in"];
edgeSlab = List.FilterByBoolMask(elements, bool6)["in"];
structuralFoundation = List.FilterByBoolMask(elements, bool7)["in"];
# ----------------------------------------
string_from_object = FromObject(object=code_block_7.floors)
code_block_8 = CodeBlock(floors=code_block_7.floors, str=string_from_object) { floors; bool1 = str == "Floor"; realFloors = List.FilterByBoolMask(floors, bool1)["in"]; }
делю_стены_на_ниже_нуля_выше = CodeBlock(zeroLowLevel=code_block.zeroLowLevel, zeroLowLevelOff=code_block.zeroLowLevelOff, zeroHighLevel=code_block.zeroHighLevel, zeroHighLevelOff=code_block.zeroHighLevelOff, BL=шина_имени_параметров.Base_Level_Param_Name, TL=шина_имени_параметров.Top_Level_Param_Name, BLO=шина_имени_параметров.Base_Level_Offset_Param_Name, TLO=шина_имени_параметров.Top_Level_Offset_Param_Name, UH=шина_имени_параметров.Unconnected_Height_Param_Name, LVL=шина_имени_параметров.Level_Param_Name, LO=шина_имени_параметров.Height_Offset_From_Level_Param_Name, walls=code_block_7.walls, floors=code_block_8.realFloors)  # "Делю стены на ниже нуля, выше нуля и те, которые надо проанализировать"
# ---------- делю_стены_на_ниже_нуля_выше.designscript (43 lines) ----------
zeroLowLevel;
zeroLowLevelOff;
zeroHighLevel;
zeroHighLevelOff;
BL;
TL;
BLO;
TLO;
UH;
LVL;
LO;
walls;
floors;

zeroLowLevelElev = Math.Round(Level.Elevation(zeroLowLevel)+zeroLowLevelOff);
zeroHighLevelElev = Math.Round(Level.Elevation(zeroHighLevel)+zeroHighLevelOff);

wallsTopLevel = Element.GetParameterValueByName(walls, TL);
wallsTopLevelOffset = Element.GetParameterValueByName(walls, TLO);
wallsBaseLevel = Element.GetParameterValueByName(walls, BL);
wallsBaseLevelOffset = Element.GetParameterValueByName(walls, BLO);
wallsUnconnectedHeight = Element.GetParameterValueByName(walls, UH);

TLBool = DSCore.Object.Type(wallsTopLevel)=="System.String";
wallsTopLevelElev = TLBool? Math.Round(wallsBaseLevel.Elevation + wallsUnconnectedHeight) : Math.Round(wallsTopLevel.Elevation + wallsTopLevelOffset);

wallsBaseLevelElev = Math.Round(wallsBaseLevel.Elevation + wallsBaseLevelOffset);

bool1 = wallsBaseLevelElev>=zeroHighLevelElev;
bool2 = wallsTopLevelElev<=zeroLowLevelElev;
filter1 = List.FilterByBoolMask(walls, bool1);
filter2 = List.FilterByBoolMask(walls, bool2);

bool3 = wallsBaseLevelElev<zeroHighLevelElev;
bool4 = wallsTopLevelElev>zeroLowLevelElev;
filter3 = List.FilterByBoolMask(walls, bool3 && bool4);
filter4 = List.FilterByBoolMask(wallsBaseLevelElev, bool3 && bool4);
filter5 = List.FilterByBoolMask(wallsTopLevelElev, bool3 && bool4);
wallsBaseLevelElevToInspect = Dictionary.ValueAtKey(filter4, "in");
wallsTopLevelElevToInspect = Dictionary.ValueAtKey(filter5, "in");
wallsToInspectForSplit = Dictionary.ValueAtKey(filter3, "in");
wallsAboveZero = Dictionary.ValueAtKey(filter1, "in");
wallsBelowZero = Dictionary.ValueAtKey(filter2, "in");
# ----------------------------------------
ищу_плиты_нуля = CodeBlock(zeroLowLevel=делю_стены_на_ниже_нуля_выше.zeroLowLevel, zeroHighLevel=делю_стены_на_ниже_нуля_выше.zeroHighLevel, BL=делю_стены_на_ниже_нуля_выше.BL, TL=делю_стены_на_ниже_нуля_выше.TL, BLO=делю_стены_на_ниже_нуля_выше.BLO, TLO=делю_стены_на_ниже_нуля_выше.TLO, UH=делю_стены_на_ниже_нуля_выше.UH, LVL=делю_стены_на_ниже_нуля_выше.LVL, LO=делю_стены_на_ниже_нуля_выше.LO, floors=делю_стены_на_ниже_нуля_выше.floors, zeroLowLevelElev=делю_стены_на_ниже_нуля_выше.zeroLowLevelElev, zeroHighLevelElev=делю_стены_на_ниже_нуля_выше.zeroHighLevelElev)
# ---------- ищу_плиты_нуля.designscript (22 lines) ----------
zeroLowLevel;
zeroHighLevel;
BL;
TL;
BLO;
TLO;
UH;
LVL;
LO;
floors;
zeroLowLevelElev;
zeroHighLevelElev;
floorsLevel = Element.GetParameterValueByName(floors, LVL);
floorsLevelOffset = Element.GetParameterValueByName(floors, LO);
floorsLevelElevation = Math.Round(Level.Elevation(floorsLevel)+floorsLevelOffset);
bool1 = floorsLevelElevation<=zeroHighLevelElev;
bool2 = floorsLevelElevation>=zeroLowLevelElev;
filter1 = List.FilterByBoolMask(floors, bool1 && bool2);
filter2 = List.FilterByBoolMask(floorsLevelElevation, bool1 && bool2);

zeroLevelFloorsElevation = Dictionary.ValueAtKey(filter2, "in");
zeroLevelFloors = Dictionary.ValueAtKey(filter1, "in");
# ----------------------------------------
границы_плиты = Python(IN[0]=ищу_плиты_нуля.zeroLevelFloors)  # IronPython2
# ---------- границы_плиты.python (30 lines) ----------
import clr
from System.Collections.Generic import *
clr.AddReference('RevitAPI')
from Autodesk.Revit.DB import *
import Autodesk

clr.AddReference("RevitNodes")
import Revit
clr.ImportExtensions(Revit.Elements)
clr.ImportExtensions(Revit.GeometryConversion)

clr.AddReference("RevitServices")
import RevitServices
from RevitServices.Persistence import DocumentManager
from RevitServices.Transactions import TransactionManager

doc = DocumentManager.Instance.CurrentDBDocument

floors = UnwrapElement(IN[0])
polycurve = []

for f in floors:
  am = Floor.GetAnalyticalModel(f)
  amCurve = doc.GetElement(f.SketchId).Profile
  DaC = []
  for amC in amCurve:
    DaC.append(amC.ToProtoType())
  polycurve.append(DaC)

OUT = polycurve
# ----------------------------------------

# group: Floors
преобразовываю_плиты_в = CodeBlock(floors=ищу_плиты_нуля.floors, zeroLowLevelElev=ищу_плиты_нуля.zeroLowLevelElev, zeroHighLevelElev=ищу_плиты_нуля.zeroHighLevelElev, floorsLevelElevation=ищу_плиты_нуля.floorsLevelElevation, zeroLevelFloorsElevation=ищу_плиты_нуля.zeroLevelFloorsElevation, floorCurves=границы_плиты)  # "Преобразовываю плиты в поверхности и разделяю их на выше и ниже нуля"
# ---------- преобразовываю_плиты_в.designscript (19 lines) ----------
floors;
zeroLowLevelElev;
zeroHighLevelElev;
floorsLevelElevation;


bool1 = floorsLevelElevation>zeroHighLevelElev;
filter1 = List.FilterByBoolMask(floors, bool1);
floorsAboveZero = Dictionary.ValueAtKey(filter1, "in");
floorsBelowZero = Dictionary.ValueAtKey(filter1, "out");

zeroLevelFloorsElevation;
floorCurves;
fPlane = Plane.ByOriginNormal(Point.ByCoordinates(0, 0, zeroLevelFloorsElevation), Vector.ZAxis());
fCurves = Curve.PullOntoPlane(floorCurves, fPlane);
fSurface = List.Flatten(Surface.ByPatch(fCurves),-1);

zeroLowLevelElev;
zeroHighLevelElev;
# ----------------------------------------
code_block_9 = CodeBlock(floorsAboveZero=преобразовываю_плиты_в.out6, floorsBelowZero=преобразовываю_плиты_в.out7) { floorsAboveZero; floorsBelowZero; }

разделяю_стены_на_выше_и_ниже = CodeBlock(floorSurface=преобразовываю_плиты_в.out12, wallsTIFS=делю_стены_на_ниже_нуля_выше.wallsToInspectForSplit, wallsBL=делю_стены_на_ниже_нуля_выше.wallsBaseLevelElevToInspect, wallsTL=делю_стены_на_ниже_нуля_выше.wallsTopLevelElevToInspect)  # "Разделяю стены на выше и ниже нуля. Отдельно выделяю стены, которые надо разделить и стены, которые перескают более одной плиты нуля"
# ---------- разделяю_стены_на_выше_и_ниже.designscript (57 lines) ----------
floorSurface;
wallsTIFS;
wallsBL;
wallsTL;

//Фильтрую стены, которые пересекают больше двух плит или не пересекают их.
wallGeo = BoundingBox.ToCuboid(Element.BoundingBox(wallsTIFS));
bool1 = Geometry.DoesIntersect(floorSurface<2>, wallGeo<1>);
bool2 = List.CountTrue(bool1@L2<1>) != 1;
filterWalls1 = List.FilterByBoolMask(wallsTIFS, bool2);
filterBL1 = List.FilterByBoolMask(wallsBL, bool2);
filterTL1 = List.FilterByBoolMask(wallsTL, bool2);
wallsToInspectFurther = Dictionary.ValueAtKey(filterWalls1, "in");
wallsToInspectFurtherBL = Dictionary.ValueAtKey(filterBL1, "in");
wallsToInspectFurtherTL = Dictionary.ValueAtKey(filterTL1, "in");
wallsToInspect = Dictionary.ValueAtKey(filterWalls1, "out");

bool0 = List.CountTrue(bool1@L2<1>) == 0;
boolGreater1 = List.CountTrue(bool1@L2<1>) > 1;
filterWalls0 = List.FilterByBoolMask(wallsTIFS, bool0);
filterWallsBL0 = List.FilterByBoolMask(wallsBL, bool0);
filterWallsTL0 = List.FilterByBoolMask(wallsTL, bool0);
wallsIntercested0 = Dictionary.ValueAtKey(filterWalls0, "in");

filterWallsGreater1 = List.FilterByBoolMask(wallsTIFS, boolGreater1);
filterWallsBLGreater1 = List.FilterByBoolMask(wallsBL, boolGreater1);
filterWallsTLGreater1 = List.FilterByBoolMask(wallsTL, boolGreater1);

wallsIntercestedGreater1 = Dictionary.ValueAtKey(filterWallsGreater1, "in");
wallsBLGreater1 = Dictionary.ValueAtKey(filterWallsBLGreater1, "in");
wallsTLGreater1 = Dictionary.ValueAtKey(filterWallsTLGreater1, "in");

//Определю, является пересечение стены пересечением или только косанием.
//Если косание, то определеяю с какой стороны (верх или низ)
//В зависимости от места соприкосновения определяю выше или ниже нуля стена
wallsToInspectGeo = BoundingBox.ToCuboid(Element.BoundingBox(wallsToInspect));
pMin = BoundingBox.MinPoint(Element.BoundingBox(wallsToInspect));
pMax = BoundingBox.MaxPoint(Element.BoundingBox(wallsToInspect));
intersectionGeo = Geometry.Intersect(floorSurface<2>, wallsToInspectGeo<1>);
intersectionGeoClean = List.Clean(intersectionGeo@L1<1>, true);
point1 = Surface.PointAtParameter(intersectionGeoClean, 0.5, 0.5)==null?Curve.PointAtParameter(intersectionGeoClean, 0.5):Surface.PointAtParameter(intersectionGeoClean, 0.5, 0.5);
//point1 = Surface.PointAtParameter(intersectionGeoClean, 0.5, 0.5);
plane1 = Plane.ByOriginNormal(point1, Vector.ZAxis());
boolBB = List.Flatten(BoundingBox.Contains(Element.BoundingBox(wallsToInspect), point1),-1);
bool3 = List.Flatten(boolBB && Geometry.DistanceTo(pMin, plane1)<1,-1);
bool4 = List.Flatten(boolBB && Geometry.DistanceTo(pMax, plane1)<1,-1);

//filter 2 - если стена не подходит к данному условию, то её надо рассечь
//filter 3 и 4 - определяю выше или ниже нуля стена
filter2 = List.FilterByBoolMask(wallsToInspect, (bool3 || bool4));
filter3 = List.FilterByBoolMask(wallsToInspect, bool3);
filter4 = List.FilterByBoolMask(wallsToInspect, bool4);

wallsToSplit = Dictionary.ValueAtKey(filter2, "out");
wallsToWarning = List.Flatten([wallsToSplit,wallsIntercested0], -1);
wallsAboveZero2 = Dictionary.ValueAtKey(filter3, "in");
wallsBelowZero2 = Dictionary.ValueAtKey(filter4, "in");
# ----------------------------------------
code_block_10 = CodeBlock(wallsTIFS=разделяю_стены_на_выше_и_ниже.wallsIntercestedGreater1, surfaces=разделяю_стены_на_выше_и_ниже.floorSurface, wallsTL=разделяю_стены_на_выше_и_ниже.wallsTLGreater1, wallsBL=разделяю_стены_на_выше_и_ниже.wallsBLGreater1)
# ---------- code_block_10.designscript (24 lines) ----------
wallsTIFS;
//Фильтрую стены, которые пересекают больше двух плит или не пересекают их.
wallGeo = BoundingBox.ToCuboid(Element.BoundingBox(wallsTIFS));
bool1 = Geometry.DoesIntersect(surfaces<2>, wallGeo<1>);
bool2 = List.CountTrue(bool1@L2<1>) > 0;
index = List.AllIndicesOf(bool1@L2<1>, true);
floorSurfacesList = List.GetItemAtIndex(surfaces, index);
z = Surface.PointAtParameter(floorSurfacesList, 0.5, 0.5).Z;
boolTopMORE = wallsTL>List.MaximumItem(z);
boolTopEQU = wallsTL==List.MaximumItem(z);
boolTopLESSorEQU = wallsTL<=List.MaximumItem(z);
boolBottomMORE = wallsBL>List.MinimumItem(z);
boolBottomEQU = wallsBL==List.MinimumItem(z);
boolBottomLESS = wallsBL<List.MinimumItem(z);
boolAbove = boolTopMORE && boolBottomEQU;
boolBelow = boolTopLESSorEQU;
boolRepair = !boolAbove && !boolBelow;
filter1 = List.FilterByBoolMask(wallsTIFS, boolAbove);
filter2 = List.FilterByBoolMask(wallsTIFS, boolBelow);
filter3 = List.FilterByBoolMask(wallsTIFS, boolRepair);

wallsAboveZero4 = Dictionary.ValueAtKey(filter1, "in");
wallsBelowZero4 = Dictionary.ValueAtKey(filter2, "in");
wallsToRepair = Dictionary.ValueAtKey(filter3, "in");
# ----------------------------------------

# group: Structural Columns
code_block_11 = CodeBlock(fSurface=преобразовываю_плиты_в.out12, zeroLowLevelElev=преобразовываю_плиты_в.out13, zeroHighLevelElev=преобразовываю_плиты_в.out14) { fSurface; zeroLowLevelElev; zeroHighLevelElev; }
work_plane = CodeBlock { "FAMILY_BASE_LEVEL_PARAM"; }
builtinparameter_name_to_8 = Python(IN[0]=work_plane)  # "BuiltInParameter Name to Parameter Name"; IronPython2; same code as builtinparameter_name_to
work_plane_2 = CodeBlock { "FAMILY_TOP_LEVEL_PARAM"; }
builtinparameter_name_to_9 = Python(IN[0]=work_plane_2)  # "BuiltInParameter Name to Parameter Name"; IronPython2; same code as builtinparameter_name_to
work_plane_3 = CodeBlock { "FAMILY_BASE_LEVEL_OFFSET_PARAM"; }
builtinparameter_name_to_10 = Python(IN[0]=work_plane_3)  # "BuiltInParameter Name to Parameter Name"; IronPython2; same code as builtinparameter_name_to
work_plane_4 = CodeBlock { "FAMILY_TOP_LEVEL_OFFSET_PARAM"; }
builtinparameter_name_to_11 = Python(IN[0]=work_plane_4)  # "BuiltInParameter Name to Parameter Name"; IronPython2; same code as builtinparameter_name_to
шина_имени_параметров_2 = CodeBlock(Base_Level_Param_Name=builtinparameter_name_to_8, Top_Level_Param_Name=builtinparameter_name_to_9, Base_Level_Offset_Param_Name=builtinparameter_name_to_10, Top_Level_Offset_Param_Name=builtinparameter_name_to_11) { Base_Level_Param_Name; Top_Level_Param_Name; Base_Level_Offset_Param_Name; Top_Level_Offset_Param_Name; }
делю_колнны_на_ниже_нуля_выше = CodeBlock(zeroLowLevelElev=code_block_11.zeroLowLevelElev, zeroHighLevelElev=code_block_11.zeroHighLevelElev, columns=code_block_7.structuralColumns, BL=шина_имени_параметров_2.Base_Level_Param_Name, TL=шина_имени_параметров_2.Top_Level_Param_Name, BLO=шина_имени_параметров_2.Base_Level_Offset_Param_Name, TLO=шина_имени_параметров_2.Top_Level_Offset_Param_Name)  # "Делю колнны на ниже нуля, выше нуля и те, которые надо проанализировать"
# ---------- делю_колнны_на_ниже_нуля_выше.designscript (35 lines) ----------
zeroLowLevelElev;
zeroHighLevelElev;
columns;
BL;
TL;
BLO;
TLO;

columnsTopLevel = Element.GetParameterValueByName(columns, TL);
columnsTopLevelOffset = Element.GetParameterValueByName(columns, TLO);
columnsBaseLevel = Element.GetParameterValueByName(columns, BL);
columnsBaseLevelOffset = Element.GetParameterValueByName(columns, BLO);


columnsTopLevelElev = Math.Round(columnsTopLevel.Elevation + columnsTopLevelOffset);
columnsBaseLevelElev = Math.Round(columnsBaseLevel.Elevation + columnsBaseLevelOffset);

bool1 = columnsBaseLevelElev>=zeroHighLevelElev;
bool2 = columnsTopLevelElev<=zeroLowLevelElev;
filter1 = List.FilterByBoolMask(columns, bool1);
filter2 = List.FilterByBoolMask(columns, bool2);



bool3 = columnsBaseLevelElev<zeroHighLevelElev;
bool4 = columnsTopLevelElev>zeroLowLevelElev;
filter3 = List.FilterByBoolMask(columns, bool3 && bool4);
filter4 = List.FilterByBoolMask(columnsBaseLevelElev, bool3 && bool4);
filter5 = List.FilterByBoolMask(columnsTopLevelElev, bool3 && bool4);
columnsBaseLevelElevToInspect = Dictionary.ValueAtKey(filter4, "in");
columnsTopLevelElevToInspect = Dictionary.ValueAtKey(filter5, "in");
columnsToInspectForSplit = Dictionary.ValueAtKey(filter3, "in");

columnsAboveZero = Dictionary.ValueAtKey(filter1, "in");
columnssBelowZero = Dictionary.ValueAtKey(filter2, "in");
# ----------------------------------------
code_block_12 = CodeBlock(columnsAboveZero1=делю_колнны_на_ниже_нуля_выше.columnsAboveZero, columnssBelowZero1=делю_колнны_на_ниже_нуля_выше.columnssBelowZero) { columnsAboveZero1; columnssBelowZero1; }
code_block_13 = CodeBlock(BL=делю_колнны_на_ниже_нуля_выше.BL, TL=делю_колнны_на_ниже_нуля_выше.TL, BLO=делю_колнны_на_ниже_нуля_выше.BLO, TLO=делю_колнны_на_ниже_нуля_выше.TLO, columns=делю_колнны_на_ниже_нуля_выше.columnsToInspectForSplit)
# ---------- code_block_13.designscript (25 lines) ----------
BL;
TL;
BLO;
TLO;

columns;

columnsTopLevel = Element.GetParameterValueByName(columns, TL);
columnsTopLevelOffset = Element.GetParameterValueByName(columns, TLO);
columnsBaseLevel = Element.GetParameterValueByName(columns, BL);
columnsBaseLevelOffset = Element.GetParameterValueByName(columns, BLO);

columnsTopLevelElev = Math.Round(columnsTopLevel.Elevation + columnsTopLevelOffset);
columnsBaseLevelElev = Math.Round(columnsBaseLevel.Elevation + columnsBaseLevelOffset);

geo = Element.GetLocation(columns);
x1 = DSCore.Object.Type(geo)=="Autodesk.DesignScript.Geometry.Point"? Point.X(geo): Point.X(Line.StartPoint(geo));
y1 = DSCore.Object.Type(geo)=="Autodesk.DesignScript.Geometry.Point"? Point.Y(geo): Point.Y(Line.StartPoint(geo));
z1 = columnsBaseLevelElev;
x2 = DSCore.Object.Type(geo)=="Autodesk.DesignScript.Geometry.Point"? x1: Point.X(Line.EndPoint(geo));
y2 = DSCore.Object.Type(geo)=="Autodesk.DesignScript.Geometry.Point"? y1: Point.Y(Line.EndPoint(geo));
z2 = columnsTopLevelElev;
pStart = Point.ByCoordinates(x1, y1, z1);
pEnd = Point.ByCoordinates(x2, y2, z2);
columnLine = Line.ByStartPointEndPoint(pStart, pEnd);
# ----------------------------------------
code_block_14 = CodeBlock(floorSurface=code_block_11.fSurface, columnsTIFS=code_block_13.columns, columnLines=code_block_13.columnLine)
# ---------- code_block_14.designscript (35 lines) ----------
floorSurface;

columnsTIFS;
columnLines;

//Фильтрую колонны, которые пересекают больше двух плит или не пересекают их.

bool1 = Geometry.DoesIntersect(floorSurface<2>, columnLines<1>);
bool2 = List.CountTrue(bool1@L2<1>) != 1;
filter1 = List.FilterByBoolMask(columnsTIFS, bool2);
filter2 = List.FilterByBoolMask(columnLines, bool2);
columnsToRepair = Dictionary.ValueAtKey(filter1, "in");
columnsToInspect = Dictionary.ValueAtKey(filter1, "out");

//Определю, является пересечение линий колонн пересечением или только косанием.
//Если косание, то определеяю с какой стороны (верх или низ)
//В зависимости от места соприкосновения определяю выше или ниже нуля колонна
columnsToInspectLines = Dictionary.ValueAtKey(filter2, "out");
pMin = Line.StartPoint(columnsToInspectLines);
pMax = Line.EndPoint(columnsToInspectLines);
intersectionGeo = Geometry.Intersect(floorSurface<2>, columnsToInspectLines<1>);
intersectionGeoClean =List.Flatten(List.Clean(intersectionGeo@L1<1>, true), -1);
plane1 = Plane.ByOriginNormal(intersectionGeoClean, Vector.ZAxis());
bool3 = Geometry.DistanceTo(pMin, plane1)<1;
bool4 = Geometry.DistanceTo(pMax, plane1)<1;

//filter 3 - если колонна не подходит к данному условию, то её надо рассечь
//filter 4 и 5 - определяю выше или ниже нуля стена
filter3 = List.FilterByBoolMask(columnsToInspect, (bool3 || bool4));
filter4 = List.FilterByBoolMask(columnsToInspect, bool3);
filter5 = List.FilterByBoolMask(columnsToInspect, bool4);

columnsToSplit = Dictionary.ValueAtKey(filter3, "out");
columnsAboveZero2 = Dictionary.ValueAtKey(filter4, "in");
columnsBelowZero2 = Dictionary.ValueAtKey(filter5, "in");
# ----------------------------------------

разделяю_стены_на_выше_и_ниже_2 = CodeBlock(floorSurface=преобразовываю_плиты_в.out12, colTIFS=делю_колнны_на_ниже_нуля_выше.columnsToInspectForSplit, colBL=делю_колнны_на_ниже_нуля_выше.columnsBaseLevelElevToInspect, colTL=делю_колнны_на_ниже_нуля_выше.columnsTopLevelElevToInspect)  # "Разделяю стены на выше и ниже нуля. Отдельно выделяю стены, которые надо разделить и стены, которые перескают более одной плиты нуля"
# ---------- разделяю_стены_на_выше_и_ниже_2.designscript (57 lines) ----------
floorSurface;
colTIFS;
colBL;
colTL;

//Фильтрую стены, которые пересекают больше двух плит или не пересекают их.
wallGeo = BoundingBox.ToCuboid(Element.BoundingBox(colTIFS));
bool1 = Geometry.DoesIntersect(floorSurface<2>, wallGeo<1>);
bool2 = List.CountTrue(bool1@L2<1>) != 1;
filterCol1 = List.FilterByBoolMask(colTIFS, bool2);
filterBL1 = List.FilterByBoolMask(colBL, bool2);
filterTL1 = List.FilterByBoolMask(colBL, bool2);
colToInspectFurther = Dictionary.ValueAtKey(filterCol1, "in");
colToInspectFurtherBL = Dictionary.ValueAtKey(filterBL1, "in");
colToInspectFurtherTL = Dictionary.ValueAtKey(filterTL1, "in");
colToInspect = Dictionary.ValueAtKey(filterCol1, "out");

bool0 = List.CountTrue(bool1@L2<1>) == 0;
boolGreater1 = List.CountTrue(bool1@L2<1>) > 1;
filterCol0 = List.FilterByBoolMask(colTIFS, bool0);
filterColBL0 = List.FilterByBoolMask(colBL, bool0);
filterColTL0 = List.FilterByBoolMask(colTL, bool0);
colIntercested0 = Dictionary.ValueAtKey(filterCol0, "in");

filterColGreater1 = List.FilterByBoolMask(colTIFS, boolGreater1);
filterColBLGreater1 = List.FilterByBoolMask(colBL, boolGreater1);
filterColTLGreater1 = List.FilterByBoolMask(colTL, boolGreater1);

colIntercestedGreater1 = Dictionary.ValueAtKey(filterColGreater1, "in");
colBLGreater1 = Dictionary.ValueAtKey(filterColBLGreater1, "in");
colTLGreater1 = Dictionary.ValueAtKey(filterColTLGreater1, "in");

//Определю, является пересечение стены пересечением или только косанием.
//Если косание, то определеяю с какой стороны (верх или низ)
//В зависимости от места соприкосновения определяю выше или ниже нуля стена
colToInspectGeo = BoundingBox.ToCuboid(Element.BoundingBox(colToInspect));
pMin = BoundingBox.MinPoint(Element.BoundingBox(colToInspect));
pMax = BoundingBox.MaxPoint(Element.BoundingBox(colToInspect));
intersectionGeo = Geometry.Intersect(floorSurface<2>, colToInspectGeo<1>);
intersectionGeoClean = List.Clean(intersectionGeo@L1<1>, true);
point1 = Surface.PointAtParameter(intersectionGeoClean, 0.5, 0.5)==null?Curve.PointAtParameter(intersectionGeoClean, 0.5):Surface.PointAtParameter(intersectionGeoClean, 0.5, 0.5);
//point1 = Surface.PointAtParameter(intersectionGeoClean, 0.5, 0.5);
plane1 = Plane.ByOriginNormal(point1, Vector.ZAxis());
boolBB = List.Flatten(BoundingBox.Contains(Element.BoundingBox(colToInspect), point1),-1);
bool3 = List.Flatten(boolBB && Geometry.DistanceTo(pMin, plane1)<1,-1);
bool4 = List.Flatten(boolBB && Geometry.DistanceTo(pMax, plane1)<1,-1);

//filter 2 - если стена не подходит к данному условию, то её надо рассечь
//filter 3 и 4 - определяю выше или ниже нуля стена
filter2 = List.FilterByBoolMask(colToInspect, (bool3 || bool4));
filter3 = List.FilterByBoolMask(colToInspect, bool3);
filter4 = List.FilterByBoolMask(colToInspect, bool4);

colToSplit = Dictionary.ValueAtKey(filter2, "out");
colToWarning = List.Flatten([colToSplit,colIntercested0], -1);
colAboveZero2 = Dictionary.ValueAtKey(filter3, "in");
colBelowZero2 = Dictionary.ValueAtKey(filter4, "in");
# ----------------------------------------
code_block_15 = CodeBlock(wallsTIFS=разделяю_стены_на_выше_и_ниже_2.colIntercestedGreater1, surfaces=разделяю_стены_на_выше_и_ниже_2.floorSurface, wallsTL=разделяю_стены_на_выше_и_ниже_2.colTLGreater1, wallsBL=разделяю_стены_на_выше_и_ниже_2.colBLGreater1)  # same code as code_block_10

# group: Предупреждение
code_block_16 = CodeBlock(a=code_block_2.idsToExcept) { a==""?"0":a; }
code_block_17 = CodeBlock { ","; }
split = String.Split(string=code_block_16, separator0=code_block_17)
trimWhitespace = String.TrimWhitespace(string=split)
исключаю_указанные_id_элементов = CodeBlock(wallsToRepair=code_block_10.wallsToRepair, wallsToSplit=разделяю_стены_на_выше_и_ниже.wallsToWarning, columnsToRepair=code_block_15.wallsToRepair, columnsToSplit=разделяю_стены_на_выше_и_ниже_2.colToWarning, IDS=trimWhitespace)
# ---------- исключаю_указанные_id_элементов.designscript (17 lines) ----------
wallsToRepair;
wallsToSplit;
walls = List.Flatten([wallsToRepair, wallsToSplit],-1);
columnsToRepair;
columnsToSplit;
columns = List.Flatten([columnsToRepair, columnsToSplit],-1);
wallsElemIDs = Elements.Element.Id(walls);
columnsElemIDs = Elements.Element.Id(columns);
ids = String.ToNumber(String.TrimWhitespace(IDS));
wallsBool1 = wallsElemIDs<1> == ids<2>;
wallsBool2 = List.AnyTrue(wallsBool1<1>);
notRepairedWalls = List.FilterByBoolMask(walls, wallsBool2)["out"];
repairedWalls = List.FilterByBoolMask(walls, wallsBool2)["in"];
columnsBool1 = columnsElemIDs<1> == ids<2>;
columnsBool2 = List.AnyTrue(columnsBool1<1>);
notRepairedColumns = List.FilterByBoolMask(columns, columnsBool2)["out"];
repairedColumns = List.FilterByBoolMask(columns, columnsBool2)["in"];
# ----------------------------------------
code_block_18 = CodeBlock(walls=исключаю_указанные_id_элементов.repairedWalls, text_FAM_UndergroundUP=code_block_3.text_FAM_UndergroundUP, text_FAM_UndergroundDOWN=code_block_3.text_FAM_UndergroundDOWN)
# ---------- code_block_18.designscript (21 lines) ----------
wType = walls.GetParameterValueByName(Apex.ParameterName("ELEM_TYPE_PARAM"));

wParameter1 = Element.GetParameterValueByName(walls, "FAM_Underground");
wParameter2 = Element.GetParameterValueByName(wType, "FAM_Underground");
wFAM_Undeground = wParameter1 == ""? wParameter2: wParameter1;

wBoolNo1 = wFAM_Undeground == "Нет";
wBoolNo2 = wFAM_Undeground == "No";
wBoolNo3 = wFAM_Undeground == text_FAM_UndergroundUP;
wBoolNo = wBoolNo1 || wBoolNo2 || wBoolNo3;

wBoolYes1 = wFAM_Undeground == "Да";
wBoolYes2 = wFAM_Undeground == "Yes";
wBoolYes3 = wFAM_Undeground == text_FAM_UndergroundDOWN;
wBoolYes = wBoolYes1 || wBoolYes2 || wBoolYes3;

wBoolWrong = !wBoolNo && !wBoolYes;

wallsAZ3 = List.Clean(wBoolNo?walls:null, false);
wallsBZ3 = List.Clean(wBoolYes?walls:null, false);
wallsWrong = List.Clean(wBoolWrong?walls:null, false);
# ----------------------------------------
code_block_19 = CodeBlock(collumns=исключаю_указанные_id_элементов.repairedColumns, text_FAM_UndergroundUP=code_block_3.text_FAM_UndergroundUP, text_FAM_UndergroundDOWN=code_block_3.text_FAM_UndergroundDOWN)
# ---------- code_block_19.designscript (21 lines) ----------
cType = collumns.GetParameterValueByName(Apex.ParameterName("ELEM_TYPE_PARAM"));

cParameter1 = Element.GetParameterValueByName(collumns, "FAM_Underground");
cParameter2 = Element.GetParameterValueByName(cType, "FAM_Underground");
cFAM_Undeground = cParameter1 == ""? cParameter2: cParameter1;

cBoolNo1 = cFAM_Undeground == "Нет";
cBoolNo2 = cFAM_Undeground == "No";
cBoolNo3 = cFAM_Undeground == text_FAM_UndergroundUP;
cBoolNo = cBoolNo1 || cBoolNo2 || cBoolNo3;

cBoolYes1 = cFAM_Undeground == "Да";
cBoolYes2 = cFAM_Undeground == "Yes";
cBoolYes3 = cFAM_Undeground == text_FAM_UndergroundDOWN;
cBoolYes = cBoolYes1 || cBoolYes2 || cBoolYes3;

cBoolWrong = !cBoolNo && !cBoolYes;

collumnsAZ3 = List.Clean(cBoolNo?collumns:null, false);
collumnsBZ3 = List.Clean(cBoolYes?collumns:null, false);
collumnsWrong = List.Clean(cBoolWrong?collumns:null, false);
# ----------------------------------------

# group: Walls
code_block_20 = CodeBlock(wallsToInspectForSplit=делю_стены_на_ниже_нуля_выше.wallsToInspectForSplit, wallsAboveZero1=делю_стены_на_ниже_нуля_выше.wallsAboveZero, wallsBelowZero1=делю_стены_на_ниже_нуля_выше.wallsBelowZero) { wallsToInspectForSplit; wallsAboveZero1; wallsBelowZero1; }
code_block_21 = CodeBlock(wallsAboveZero1=code_block_20.wallsAboveZero1, wallsBelowZero1=code_block_20.wallsBelowZero1, wallsAboveZero2=разделяю_стены_на_выше_и_ниже.wallsAboveZero2, wallsBelowZero2=разделяю_стены_на_выше_и_ниже.wallsBelowZero2, wallsAboveZero4=code_block_10.wallsAboveZero4, wallsBelowZero4=code_block_10.wallsBelowZero4) { wallsAboveZero1; wallsBelowZero1; wallsAboveZero2; wallsBelowZero2; wallsAboveZero4; wallsBelowZero4; }
code_block_22 = CodeBlock(wallsAboveZero1=code_block_21.wallsAboveZero1, wallsBelowZero1=code_block_21.wallsBelowZero1, wallsAboveZero2=code_block_21.wallsAboveZero2, wallsBelowZero2=code_block_21.wallsBelowZero2, wallsAboveZero3=code_block_18.wallsAZ3, wallsBelowZero3=code_block_18.wallsBZ3, wallsAboveZero4=code_block_21.wallsAboveZero4, wallsBelowZero4=code_block_21.wallsBelowZero4)
# ---------- code_block_22.designscript (11 lines) ----------
wallsAboveZero1;
wallsBelowZero1;
wallsAboveZero2;
wallsBelowZero2;
wallsAboveZero3;
wallsBelowZero3;
wallsAboveZero4;
wallsBelowZero4;

wallsAboveZero = List.Clean(List.Join([wallsAboveZero1, wallsAboveZero2, wallsAboveZero3, wallsAboveZero4]));
wallsBelowZero = List.Join([wallsBelowZero1, wallsBelowZero2, wallsBelowZero3, wallsBelowZero4]);
# ----------------------------------------
code_block_23 = CodeBlock(wallsAboveZero=code_block_22.wallsAboveZero, wallsBelowZero=code_block_22.wallsBelowZero) { wallsAboveZero; wallsBelowZero; }

# group: Structural Framing
разделяю_балки_на_выше_и_ниже = CodeBlock(zeroHighLevelElev=преобразовываю_плиты_в.out14, beams=code_block_7.structuralFraming)  # "Разделяю балки на выше и ниже нуля"
# ---------- разделяю_балки_на_выше_и_ниже.designscript (15 lines) ----------
zeroHighLevelElev;
beams;
RL = Apex.ParameterName("TRUSS_ELEMENT_REFERENCE_LEVEL_PARAM");
ELO = Apex.ParameterName("TRUSS_ELEMENT_END1_ELEVATION");
SLO = Apex.ParameterName("TRUSS_ELEMENT_END0_ELEVATION");
ZOV = Apex.ParameterName("Z_OFFSET_VALUE");
beamLevel = Element.GetParameterValueByName(beams, RL);
beamELO = Element.GetParameterValueByName(beams, ELO);
beamSLO = Element.GetParameterValueByName(beams, SLO);
beamZOV = Element.GetParameterValueByName(beams, ZOV);
beamElevation = Math.Round(beamLevel.Elevation + (beamELO+beamSLO)/2+beamZOV);
bool1 = beamElevation>zeroHighLevelElev;
filter1 = List.FilterByBoolMask(beams, bool1);
beamsAboveZero = Dictionary.ValueAtKey(filter1, "in");
beamsBelowZero = Dictionary.ValueAtKey(filter1, "out");
# ----------------------------------------
code_block_24 = CodeBlock(beamsAboveZero=разделяю_балки_на_выше_и_ниже.beamsAboveZero, beamsBelowZero=разделяю_балки_на_выше_и_ниже.beamsBelowZero) { beamsAboveZero; beamsBelowZero; }

code_block_25 = CodeBlock(wallsAboveZero=code_block_23.wallsAboveZero, wallsBelowZero=code_block_23.wallsBelowZero, floorsAboveZero=code_block_9.floorsAboveZero, floorsBelowZero=code_block_9.floorsBelowZero, beamsAboveZero=code_block_24.beamsAboveZero, beamsBelowZero=code_block_24.beamsBelowZero) { wallsAboveZero; wallsBelowZero; floorsAboveZero; floorsBelowZero; beamsAboveZero; beamsBelowZero; }

# group (continued): Structural Columns
code_block_26 = CodeBlock(columnsAboveZero3=code_block_19.collumnsAZ3, columnsBelowZero3=code_block_19.collumnsBZ3, columnsAboveZero2=разделяю_стены_на_выше_и_ниже_2.colAboveZero2, columnsBelowZero2=разделяю_стены_на_выше_и_ниже_2.colBelowZero2, columnsAboveZero1=code_block_12.columnsAboveZero1, columnsBelowZero1=code_block_12.columnssBelowZero1, columnsAboveZero4=code_block_15.wallsAboveZero4, columnsBelowZero4=code_block_15.wallsBelowZero4)
# ---------- code_block_26.designscript (12 lines) ----------
columnsAboveZero3;
columnsBelowZero3;
columnsAboveZero2;
columnsBelowZero2;
columnsAboveZero1;
columnsBelowZero1;
columnsAboveZero4;
columnsBelowZero4;


columnsAboveZero = List.Join([columnsAboveZero1, columnsAboveZero2, columnsAboveZero3, columnsAboveZero4]);
columnsAndPilesBelowZero = List.Join([columnsBelowZero1, columnsBelowZero2, columnsBelowZero3, columnsBelowZero4]);
# ----------------------------------------
code_block_27 = CodeBlock(columnsAboveZero=code_block_26.columnsAboveZero, columnsAndPilesBelowZero=code_block_26.columnsAndPilesBelowZero) { columnsAboveZero; columnsAndPilesBelowZero; }

code_block_28 = CodeBlock(zeroLevelFloorsElevation=преобразовываю_плиты_в.out8, fPlane=преобразовываю_плиты_в.out10, fSurface=преобразовываю_плиты_в.out12, zeroLowLevelElev=преобразовываю_плиты_в.out13, zeroHighLevelElev=преобразовываю_плиты_в.out14) { zeroLevelFloorsElevation; fPlane; fSurface; zeroLowLevelElev; zeroHighLevelElev; }

# group: Generic Models (Лестницы и термовкладыши)
string_from_object_2 = FromObject(object=code_block_7.genericModel)
code_block_29 = CodeBlock(genericModel=code_block_7.genericModel, str=string_from_object_2)
# ---------- code_block_29.designscript (12 lines) ----------
genericModel;
bool1 = str != "ModelText";
filter1 = List.FilterByBoolMask(genericModel, bool1);
genericFamilies = Dictionary.ValueAtKey(filter1, "in");
genericFamiliesNames = Family.Name(FamilyInstance.GetFamily(genericFamilies));
bool2 = String.Contains(genericFamiliesNames, "Stair", false);
filter2 = List.FilterByBoolMask(genericFamilies , bool2);
stairs = Dictionary.ValueAtKey(filter2, "in");

bool3 = String.Contains(genericFamiliesNames, "_HeatInsulating", false);
filter3 = List.FilterByBoolMask(genericFamilies , bool3);
heatInsulating = Dictionary.ValueAtKey(filter3, "in");
# ----------------------------------------
work_plane_5 = CodeBlock { "FAMILY_LEVEL_PARAM"; }
builtinparameter_name_to_12 = Python(IN[0]=work_plane_5)  # "BuiltInParameter Name to Parameter Name"; IronPython2; same code as builtinparameter_name_to
work_plane_6 = CodeBlock { "INSTANCE_ELEVATION_PARAM"; }
builtinparameter_name_to_13 = Python(IN[0]=work_plane_6)  # "BuiltInParameter Name to Parameter Name"; IronPython2; same code as builtinparameter_name_to
шина_имени_параметров_3 = CodeBlock(Level_Param_Name=builtinparameter_name_to_12, Level_Offset_Param_Name=builtinparameter_name_to_13) { Level_Param_Name; Level_Offset_Param_Name; }
делю_лестницы_на_ниже_нуля_выше = CodeBlock(zeroLowLevelElev=code_block_28.zeroLowLevelElev, zeroHighLevelElev=code_block_28.zeroHighLevelElev, stairs=code_block_29.stairs, L=шина_имени_параметров_3.Level_Param_Name, LO=шина_имени_параметров_3.Level_Offset_Param_Name)  # "Делю лестницы на ниже нуля, выше нуля."
# ---------- делю_лестницы_на_ниже_нуля_выше.designscript (16 lines) ----------
zeroLowLevelElev;
zeroHighLevelElev;
stairs;
L;
LO;

stairsLevel = Element.GetParameterValueByName(stairs, L);
stairsLevelOffset = Element.GetParameterValueByName(stairs, LO);

stairsElev = Math.Round(stairsLevel.Elevation + stairsLevelOffset);

bool1 = stairsElev>=zeroHighLevelElev;
filter1 = List.FilterByBoolMask(stairs, bool1);

stairsAboveZero1 = Dictionary.ValueAtKey(filter1, "in");
stairsToInspect = Dictionary.ValueAtKey(filter1, "out");
# ----------------------------------------
code_block_30 = CodeBlock(zeroLevelFloorsElevation=code_block_28.zeroLevelFloorsElevation, fPlane=code_block_28.fPlane, stairsAboveZero1=делю_лестницы_на_ниже_нуля_выше.stairsAboveZero1, stairsToInspect=делю_лестницы_на_ниже_нуля_выше.stairsToInspect)
# ---------- code_block_30.designscript (29 lines) ----------
zeroLevelFloorsElevation;
fPlane;
stairsAboveZero1;
stairsToInspect;

stairsCuboid = BoundingBox.ToCuboid(Element.BoundingBox(stairsToInspect));
sort = List.SortByKey(fPlane, zeroLevelFloorsElevation);
sortedPlanes = Dictionary.ValueAtKey(sort, "sortedList");
fPlaneHighest = List.Reverse(sortedPlanes)[0];

splitedGeoms = Geometry.Split(stairsCuboid, fPlaneHighest);
bool1 = List.Count(splitedGeoms@L2<1>)>1;
filter1 = List.FilterByBoolMask(stairsToInspect, bool1);
filter2 = List.FilterByBoolMask(splitedGeoms, bool1);
stairsToInspectFurther = Dictionary.ValueAtKey(filter1 , "in");
stairsToInspectSplitedGeoms = Dictionary.ValueAtKey(filter2 , "in");
stairsBelowZero1 = Dictionary.ValueAtKey(filter1, "out");

zCuboid = Point.Z(Solid.Centroid(stairsToInspectSplitedGeoms));
sorting = List.SortByKey(stairsToInspectSplitedGeoms@L2<1>, zCuboid@L2<1>);
sortedByZGeoms = List.Transpose(Dictionary.ValueAtKey(sorting, "sortedList"));
bool2 = sortedByZGeoms[0]==null?false:Solid.Volume(sortedByZGeoms[0])<=Solid.Volume(sortedByZGeoms[1]);
filter3 = List.FilterByBoolMask(stairsToInspectFurther, bool2);
stairsAboveZero2 = Dictionary.ValueAtKey(filter3, "in");
stairsBelowZero2 = Dictionary.ValueAtKey(filter3, "out");


stairsAndLandingsAboveZero = List.Join([stairsAboveZero1, stairsAboveZero2]);
stairsAndLandingsBelowZero = List.Join([stairsBelowZero1, stairsBelowZero2]);
# ----------------------------------------
code_block_31 = CodeBlock(stairsAndLandingsAboveZero=code_block_30.stairsAndLandingsAboveZero, stairsAndLandingsBelowZero=code_block_30.stairsAndLandingsBelowZero, heatInsulating=code_block_29.heatInsulating) { stairsAndLandingsAboveZero; stairsAndLandingsBelowZero; heatInsulating; }
code_block_32 = CodeBlock(stairsAndLandingsAboveZero=code_block_31.stairsAndLandingsAboveZero, stairsAndLandingsBelowZero=code_block_31.stairsAndLandingsBelowZero, heatInsulating=code_block_31.heatInsulating) { stairsAndLandingsAboveZero; stairsAndLandingsBelowZero; heatInsulating; }

# group: Slab Edge and Structural Foundation
code_block_33 = CodeBlock(edgeSlab=code_block_7.edgeSlab, structuralFoundation=code_block_7.structuralFoundation) { edgeSlab; structuralFoundation; }
code_block_34 = CodeBlock(edgeSlab=code_block_33.edgeSlab, structuralFoundation=code_block_33.structuralFoundation) { edgeSlab; structuralFoundation; }

code_block_35 = CodeBlock(columnsAboveZero=code_block_27.columnsAboveZero, columnsAndPilesBelowZero=code_block_27.columnsAndPilesBelowZero, stairsAndLandingsAboveZero=code_block_32.stairsAndLandingsAboveZero, stairsAndLandingsBelowZero=code_block_32.stairsAndLandingsBelowZero, heatInsulating=code_block_32.heatInsulating, edgeSlab=code_block_34.edgeSlab, structuralFoundation=code_block_34.structuralFoundation)
# ---------- code_block_35.designscript (7 lines) ----------
columnsAboveZero;
columnsAndPilesBelowZero;
stairsAndLandingsAboveZero;
stairsAndLandingsBelowZero;
heatInsulating;
edgeSlab;
structuralFoundation;
# ----------------------------------------
code_block_36 = CodeBlock(wAZ=code_block_25.wallsAboveZero, wBZ=code_block_25.wallsBelowZero, fAZ=code_block_25.floorsAboveZero, fBZ=code_block_25.floorsBelowZero, bAZ=code_block_25.beamsAboveZero, bBZ=code_block_25.beamsBelowZero, cAZ=code_block_35.columnsAboveZero, cBZ=code_block_35.columnsAndPilesBelowZero, gAZ=code_block_35.stairsAndLandingsAboveZero, gBZ=code_block_35.stairsAndLandingsBelowZero, hAZ=code_block_35.heatInsulating, s1=code_block_35.edgeSlab, s2=code_block_35.structuralFoundation)
# ---------- code_block_36.designscript (17 lines) ----------
wAZ;
wBZ;
fAZ;
fBZ;
bAZ;
bBZ;

cAZ;
cBZ;
gAZ;
gBZ;
hAZ;
s1;
s2;

AZ = List.Clean(List.Flatten([wAZ, cAZ, bAZ, fAZ, gAZ, hAZ],-1), false);
BZ = List.Clean(List.Flatten([wBZ, cBZ, bBZ, fBZ, gBZ, s1, s2],-1), false);
# ----------------------------------------
code_block_37 = CodeBlock(text_FAM_Underground=code_block_4.text_FAM_UndergroundUP)
# ---------- code_block_37.designscript (3 lines) ----------
text_FAM_Underground;
type = Apex.ParameterName("ELEM_TYPE_PARAM");
assembly_code = Apex.ParameterName("UNIFORMAT_CODE");
# ----------------------------------------

# group: Импортирую из Assembly Code (универсально для всех загруженных кодификаторов)
assembly_code_table_path = Python()  # IronPython2
# ---------- assembly_code_table_path.python (30 lines) ----------
import clr

# 1. Revit API
clr.AddReference("RevitAPI")  
from Autodesk.Revit.DB import *  
# 2. Revit Services (для работы с документом)
clr.AddReference("RevitServices")  
from RevitServices.Persistence import DocumentManager  
from RevitServices.Transactions import TransactionManager  

# 3. Dynamo Core (для работы с элементами Dynamo)
clr.AddReference("DSCoreNodes")  
import DSCore  

# 4. Dynamo Revit (для операций, специфичных для Revit)
clr.AddReference("RevitNodes")  
import Revit  

# 5. Преобразование Dynamo ↔ Revit (обязательно!)
clr.ImportExtensions(Revit.Elements)  
clr.ImportExtensions(Revit.GeometryConversion)  

# Получаем текущий документ Revit
doc = DocumentManager.Instance.CurrentDBDocument  
uidoc = DocumentManager.Instance.CurrentUIApplication.ActiveUIDocument  
ac = AssemblyCodeTable.GetAssemblyCodeTable(doc).GetExternalFileReference().GetAbsolutePath()
ac = ModelPathUtils.ConvertModelPathToUserVisiblePath(ac)


OUT = ac
# ----------------------------------------
file_from_path = FileObject(path=assembly_code_table_path)
readText = FileSystem.ReadText(file=file_from_path)
code_block_38 = CodeBlock()
# ---------- code_block_38.designscript (2 lines) ----------
"
";
# ----------------------------------------
split_2 = String.Split(string=readText, separator0=code_block_38)
code_block_39 = CodeBlock { "	"; }
split_3 = String.Split(string=split_2, separator0=code_block_39)
transpose = List.Transpose(lists=split_3)
code_block_40 = CodeBlock(lst=transpose) { lst; code = Get.ValueAtIndex(lst, 0); name = Get.ValueAtIndex(lst, 1); }

code_block_41 = CodeBlock(code=code_block_40.code, name=code_block_40.name)
# ---------- code_block_41.designscript (3 lines) ----------
uniqueCode = List.UniqueItems(code);
indexUnique = List.IndexOf(code,uniqueCode);
uniqueNames = List.GetItemAtIndex(name, indexUnique);
# ----------------------------------------
byKeysValues = DesignScript.Builtin.Dictionary.ByKeysValues(keys=code_block_41.uniqueCode, values=code_block_41.uniqueNames)
components = DesignScript.Builtin.Dictionary.Components(dictionary=byKeysValues)
code_block_42 = CodeBlock()
# ---------- code_block_42.designscript (94 lines) ----------
exceptionWords = ["Подзем", "Демонтаж", "штроб", "архитект",
"пробив", "анкер", "крышк", "арх", "помещ", "отдел", "срубка"];
//[[1],[2],[3]]
//anyTrue - хотя бы 1 из списка должно быть в имени
//allTrue - всё из списка обязательно должно быть в имени
//exceptions - ничего из списка не должно быть в имени
//extraTrue - {"Слово":"Приоритет"} - дополнительный приоритет, если есть
//указанные слова. Приоритет слова указывается через двоеточие. Если есть
//несколько слов, то их приоритеты складываются.
//-----------------
//4 Пилоны;
{"anyTrue":[],
"allTrue":["пилон"],
"exceptions": List.Flatten([exceptionWords],-1),
"extraTrue":[{"монолит":1}]};

//5 Парапеты;
{"anyTrue":[],
"allTrue":["парапет"],
"exceptions": List.Flatten([exceptionWords],-1),
"extraTrue":[{"монолит":1}]};

//6 Стены;
{"anyTrue":[],
"allTrue":["стен"],
"exceptions": List.Flatten([exceptionWords],-1),
"extraTrue":[{"монолит":1}]};

//7 Стены лифтовых шахт;
{"anyTrue":["стен","лифт"],
"allTrue":[],
"exceptions": List.Flatten([exceptionWords, "сбор"],-1),
"extraTrue":[{"лифтовых шахт из монолитного":10},
{"лифтовая шахта из монолитного":10},
{"монолит":1},{"стен":1}]};

//8 Балки;
{"anyTrue":["балки", "балок", "балка"],
"allTrue":[],
"exceptions": List.Flatten([exceptionWords],-1),
"extraTrue":[{"монолит":1}]};

//9 Плиты;
{"anyTrue":["плит", "перекрыт"],
"allTrue":[],
"exceptions": List.Flatten([exceptionWords,"Фунд","плит вставок деф", "шахт"],-1),
"extraTrue":[{"монолит":1}]};

//10 Капители;
{"anyTrue":[],
"allTrue":[],
"exceptions": List.Flatten([exceptionWords,"Фунд","плит вставок деф"],-1),
"extraTrue":[{"Капитель":5}, {"плит":1},{"перекрыт":1}, {"монолит":1}]};

//11 Фундаменты;
//[[], ["Фунд", "плит"], ["Подзем"]];

//12 Лестничные площадки;
{"anyTrue":["лест","Лестнич", "плит", "перекрыт"],
"allTrue":[],
"exceptions": List.Flatten([exceptionWords,"Сбор","Фунд",
"плит вставок деф", "шахт"],-1),
"extraTrue":[{"монолит":1},{"площад":2}]};

//13 Лестничные марши;
{"anyTrue":["лестниц", "лестничных маршей", "Лестничный марш", "ЛМ"],
"allTrue":[],
"exceptions": List.Flatten([exceptionWords,"Сбор", "металл", "покрыт"],-1),
"extraTrue":[{"монолит":1}]};

//14 Термовкладыши;
{"anyTrue":[],
"allTrue":["термовклад"],
"exceptions": List.Flatten([exceptionWords],-1),
"extraTrue":[]};


//15 Колонны;
{"anyTrue":[],
"allTrue":["Колон"],
"exceptions": List.Flatten([exceptionWords, "Стал", "метал"],-1),
"extraTrue":[{"монолит":1}]};

//16 Рампы;
{"anyTrue":[],
"allTrue":["рамп"],
"exceptions": List.Flatten([exceptionWords],-1),
"extraTrue":[{"монолит":1}]};

//17 Плиты вставки деформационных швов;
{"anyTrue":[],
"allTrue":["плит вставок деф"],
"exceptions": List.Flatten([exceptionWords],-1),
"extraTrue":[{"монолит":1}]};
# ----------------------------------------
code_block_43 = CodeBlock(ac4=[code_block_42.out1, code_block_42.out1], ac5=code_block_42.out2, ac6=code_block_42.out3, ac7=[code_block_42.out4, code_block_42.out4], ac8=code_block_42.out5, ac9=code_block_42.out6, ac10=code_block_42.out7, ac12=code_block_42.out8, ac13=code_block_42.out9, ac14=code_block_42.out10, ac15=code_block_42.out11, ac16=code_block_42.out12, ac17=code_block_42.out13)
# ---------- code_block_43.designscript (14 lines) ----------
[ac4,
ac5,
ac6,
ac7,
ac8,
ac9,
ac10,

ac12,
ac13,
ac14,
ac15,
ac16,
ac17];
# ----------------------------------------
python_script_2 = Python(IN[0]=components.keys, IN[1]=components.values, IN[2]=code_block_43)  # IronPython2
# ---------- python_script_2.python (83 lines) ----------
# Load the Python Standard and DesignScript Libraries
import sys
import clr
clr.AddReference('ProtoGeometry')
from Autodesk.DesignScript.Geometry import *

# The inputs to this node will be stored as a list in the IN variables.
keys = IN[0]
values = IN[1]
wordsList = IN[2]
belowZero = ["подзем", "ниже"]
myKeys = []
myValues = []
myRating = []
k=0

for words in wordsList:
	
	boolNoKey = True
	myKeysTemp = []
	myValuesTemp = []
	myRatingTemp = []
	ratingMax=0
	for i in xrange(len(values)):
	
		bool1 = any([w.ToLower() in values[i].ToLower() for w in words.get("anyTrue")])
		if len(words.get("anyTrue"))<1:
			bool1=True	
		
		bool2 = all([w.ToLower() in values[i].ToLower() for w in words.get("allTrue")])
		if len(words.get("allTrue"))<1:
			bool2=True
			
		bool3 = any([w.ToLower() in values[i].ToLower() for w in words.get("exceptions")])
		if len(words.get("exceptions"))<1:
			bool3=False
		
		rating=1	
		for w in words.get("extraTrue"):
			if w.keys()[0].ToLower() in values[i].ToLower():
				rating=rating+w.values()[0]	
		#rating=rating+sum([w.values()[0] for w in words.get("extraTrue") if w.keys()[0].ToLower() in values[i].ToLower()]):
		
		if bool1 and bool2 and not bool3 and rating>=ratingMax:
			if ratingMax==0:
				myKeysTemp.append(keys[i])
				myValuesTemp.append(values[i])
			elif rating == ratingMax:
				myKeysTemp.append(keys[i])
				myValuesTemp.append(values[i])
			else:
				myKeysTemp=[keys[i]]
				myValuesTemp=[values[i]]
			boolNoKey = False
			ratingMax = rating
			
	for mv in myValuesTemp:
		boolIn = False
		for i in xrange(len(values)):
			if mv == values[i]:
				endIndex = keys[i].rfind(".")
				upperKey=keys[i][0:endIndex]
				for j in xrange(len(keys)):
					if upperKey==keys[j]:
						if not any([bz.ToLower() in values[j].ToLower() for bz in belowZero]):
							myKeysTemp=[keys[i]]
							myValuesTemp=[values[i]]
							boolIn=True
							bool1=False
		if boolIn:
			break
				
	if boolNoKey:
		k=k+1
		myKeysTemp.append("No Key "+str(k))
		myValuesTemp.append("No Value "+str(k))
	myKeys.append(myKeysTemp)
	myValues.append(myValuesTemp)

# Place your code below this line

# Assign your output to the OUT variable.
OUT = [myKeys, myValues]
# ----------------------------------------
code_block_44 = CodeBlock(python=python_script_2) { code = List.Flatten(python[0], -1); name = List.Flatten(python[1], -1); }
code_block_45 = CodeBlock(value=code_block_44.code)
# ---------- code_block_45.designscript (13 lines) ----------
value[0];
value[1];
value[2];
value[3];
value[4];
value[5];
value[6];
value[7];
value[8];
value[9];
value[10];
value[11];
value[12];
# ----------------------------------------
code_block_46 = CodeBlock(assemblyCode_P=code_block_45.out0, assemblyCode_PA=code_block_45.out1, assemblyCode_W=code_block_45.out2, assemblyCode_CSH=code_block_45.out3, assemblyCode_Beams=code_block_45.out4, assemblyCode_F=code_block_45.out5, assemblyCode_C=code_block_45.out6, assemblyCode_LA=code_block_45.out7, assemblyCode_STA=code_block_45.out8, assemblyCode_HEAT=code_block_45.out9, assemblyCode_SCO=code_block_45.out10, assemblyCode_R=code_block_45.out11, assemblyCode_EJF=code_block_45.out12)
# ---------- code_block_46.designscript (28 lines) ----------
//4 Пилоны;
assemblyCode_P;
//5 Парапеты;
assemblyCode_PA;
//6 Стены;
assemblyCode_W;
//7 Стены лифтовых шахт;
assemblyCode_CSH;
//8 Балки;
assemblyCode_Beams;
//9 Плиты;
assemblyCode_F;
//10 Капители;
assemblyCode_C;
//11 Фундаменты;
//assemblyCode_S;
//12 Лестничные площадки;
assemblyCode_LA;
//13 Лестничные марши;
assemblyCode_STA;
//14 Термовкладыши;
assemblyCode_HEAT;
//15 Колонны;
assemblyCode_SCO;
//16 Рампы;
assemblyCode_R;
//17 Плиты вставки деформационных швов;
assemblyCode_EJF;
# ----------------------------------------
задаю_параметры_кодификатора_и = Python(IN[0]=code_block_36.AZ, IN[1]=code_block_37.text_FAM_Underground, IN[2]=code_block_37.type, IN[3]=code_block_37.assembly_code, IN[4]=code_block_46.assemblyCode_P, IN[5]=code_block_46.assemblyCode_PA, IN[6]=code_block_46.assemblyCode_W, IN[7]=code_block_46.assemblyCode_CSH, IN[8]=code_block_46.assemblyCode_Beams, IN[9]=code_block_46.assemblyCode_F, IN[10]=code_block_46.assemblyCode_C, IN[12]=code_block_46.assemblyCode_LA, IN[13]=code_block_46.assemblyCode_STA, IN[14]=code_block_46.assemblyCode_HEAT, IN[15]=code_block_46.assemblyCode_SCO, IN[16]=code_block_46.assemblyCode_R, IN[17]=code_block_46.assemblyCode_EJF)  # "Задаю параметры Кодификатора и FAM_Undeground для элементов выше нуля"; IronPython2; unwired: IN[11]
# ---------- задаю_параметры_кодификатора_и.python (165 lines) ----------
import clr

# 1. Revit API
clr.AddReference("RevitAPI")  
from Autodesk.Revit.DB import *  

# 2. Revit Services (для работы с документом)
clr.AddReference("RevitServices")  
from RevitServices.Persistence import DocumentManager  
from RevitServices.Transactions import TransactionManager  

# 3. Dynamo Core (для работы с элементами Dynamo)
clr.AddReference("DSCoreNodes")  
import DSCore  

# 4. Dynamo Revit (для операций, специфичных для Revit)
clr.AddReference("RevitNodes")  
import Revit  

# 5. Преобразование Dynamo ↔ Revit (обязательно!)
clr.ImportExtensions(Revit.Elements)  
clr.ImportExtensions(Revit.GeometryConversion)  

def Warning(warnings, text):
	war = "Не найдено описание подходящие для "+text+" в заданном классификаторе."
	if war not in warnings:
		warnings.append(war)
		
# Получаем текущий документ Revit
doc = DocumentManager.Instance.CurrentDBDocument  
uidoc = DocumentManager.Instance.CurrentUIApplication.ActiveUIDocument  

elements = IN[0]
text_FAM_Undeground = IN[1]
paramType = IN[2]
#Assembly code для Walls
paramAssCode = IN[3]
assemblyCode_P = IN[4] #Пилоны
assemblyCode_PA = IN[5] #Парапеты
assemblyCode_W = IN[6] #Стены
assemblyCode_CSH = IN[7] #Стены лифтовых шахт
#Assembly code для Walls и Structural Framings
assemblyCode_Beams = IN[8] #Балки
#Assembly code для Floors
assemblyCode_F = IN[9] #Плиты
assemblyCode_C = IN[10] #Капители
assemblyCode_R = IN[16] #Рампы
assemblyCode_EJF = IN[17] #Плиты вставки деформационных швов 
#Assembly code для Floors и Structural Foundation и Slab Edge
assemblyCode_S = IN[11] #Фундаменты
#Assembly code для Floors и Generic Models
assemblyCode_LA = IN[12] #Лестничные площадки
#Assembly code для Generic Models
assemblyCode_STA = IN[13] #Лестничные марши
assemblyCode_HEAT = IN[14] #Термовкладыши
#Assembly code для Structural Columns
assemblyCode_SCO = IN[15] #Колонны


newTypes = []
oldTypes = []
warnings = []
wrongTypes = []
for elem in elements:
	boolTypeAssCode = True
	boolTypeUndeground = True
	try:
		elem.SetParameterByName("FAM_Underground", text_FAM_Undeground)
		boolTypeUndeground = False
	except: 1
	try:
		elem.SetParameterByName(paramAssCode, "Нет такого типа")
		boolTypeAssCode = False
	except: 1
	
	type = elem.GetParameterValueByName(paramType)
	
	oldTypes.append(type.Name)
	boolBeam = False
	boolSlab = False
	boolLanding = False
	boolSTA = False
	boolSCO = False
	boolPILE = False
	boolHEAT = False
	if hasattr(type, 'Family'):
		boolBeam = "S_FRA_" in str(type.Family) and not "S_FRA_STE" in str(type.Family)
		boolLanding = "Landing" in str(type.Family)
		boolSCO = "S_SCO_RCO_Column" in str(type.Family) or "S_SCO_Column" in str(type.Family)
		boolPILE = "S_SCO_RCO_Pile"in str(type.Family) or "S_SCO_Pile"in str(type.Family)
		boolSTA = "Stair" in str(type.Family) and not boolLanding
		boolHEAT = "_HeatInsulating" in str(type.Family)
		
	newName = ""	
	newType = elem
	if boolTypeAssCode:
		if type.Name.endswith("_BGL"):
			newName = type.Name.rstrip("_BGL")
			try:
				newType = type.Duplicate(newName)
			except:
				try:
					newType = type.ByName(newName)
				except:
					newType = type.ByFamilyAndName(type.Family, newName)
		else:
			newType = type
		elem.SetParameterByName(paramType, newType)		
	if newType.Name not in newTypes or newType == elem:
		try:
			newType.SetParameterByName("FAM_Underground", text_FAM_Undeground)
		except:
			elem.SetParameterByName("FAM_Underground", text_FAM_Undeground)	
			
		if "_P_" in newType.Name:
			try: newType.SetParameterByName(paramAssCode,assemblyCode_P)
			except: Warning(warnings, "пилонов")
		elif "_PA_" in newType.Name:
			try: newType.SetParameterByName(paramAssCode,assemblyCode_PA)
			except: Warning(warnings, "парапетов")
		elif "_W_" in newType.Name:
			try: newType.SetParameterByName(paramAssCode,assemblyCode_W)
			except: Warning(warnings, "стен")
		elif "_B_" in newType.Name or boolBeam:
			try: newType.SetParameterByName(paramAssCode,assemblyCode_Beams)
			except: Warning(warnings, "балок")
		elif "_CSH_" in newType.Name:
			try: newType.SetParameterByName(paramAssCode,assemblyCode_CSH)
			except: Warning(warnings, "стен лифтовых шахт")
			
		elif "_F_" in newType.Name:
			try: newType.SetParameterByName(paramAssCode,assemblyCode_F)
			except: Warning(warnings, "плит перекрытий")
		elif "_C_" in newType.Name:
			try: newType.SetParameterByName(paramAssCode,assemblyCode_C)
			except: Warning(warnings, "капителей")
		elif "_R_" in newType.Name:
			try: newType.SetParameterByName(paramAssCode,assemblyCode_R)
			except: Warning(warnings, "рамп")
		elif "_EJF_" in newType.Name:
			try: newType.SetParameterByName(paramAssCode,assemblyCode_EJF)
			except: Warning(warnings, "плит")
		elif "_S_" in newType.Name or boolSlab:
			try: newType.SetParameterByName(paramAssCode,assemblyCode_S)
			except: Warning(warnings, "фундаментных плит")
		elif "_LA_" in newType.Name or boolLanding:
			try: newType.SetParameterByName(paramAssCode,assemblyCode_LA)
			except: Warning(warnings, "лестничных площадок из монолитного жб")
		
		elif boolSTA:
			try: newType.SetParameterByName(paramAssCode,assemblyCode_STA)
			except: Warning(warnings, "лестниц из монолитного жб")
		elif boolHEAT:
			try: newType.SetParameterByName(paramAssCode,assemblyCode_HEAT)
			except: Warning(warnings, "термовкладышей")
				
		elif boolSCO:
			try: newType.SetParameterByName(paramAssCode,assemblyCode_SCO)
			except: Warning(warnings, "колонн")
			
		else:
			wrongTypes.append(newType)
 
	newTypes.append(newType.Name)
OUT = [warnings, elements, wrongTypes]
# ----------------------------------------
code_block_47 = CodeBlock(text_FAM_Underground=code_block_4.text_FAM_UndergroundDOWN)  # same code as code_block_37
code_block_48 = CodeBlock()
# ---------- code_block_48.designscript (105 lines) ----------
exceptionWords = ["Демонтаж", "штроб", "архитект",
"пробив", "анкер", "крышк", "арх", "помещ", "отдел", "срубка"];
//[[1],[2],[3]]
//anyTrue - хотя бы 1 из списка должно быть в имени
//allTrue - всё из списка обязательно должно быть в имени
//exceptions - ничего из списка не должно быть в имени
//extraTrue - {"Слово":"Приоритет"} - дополнительный приоритет, если есть
//указанные слова. Приоритет слова указывается через двоеточие. Если есть
//несколько слов, то их приоритеты складываются.
//-----------------
//4 Пилоны;
{"anyTrue":[],
"allTrue":["пилон"],
"exceptions": List.Flatten([exceptionWords],-1),
"extraTrue":[{"Подзем":100},{"монолит":1}]};

//5 Парапеты;
//{"anyTrue":[],
//"allTrue":["парапет"],
//"exceptions": List.Flatten([exceptionWords],-1),
//"extraTrue":[{"монолит":1}]};

//6 Стены;
{"anyTrue":[],
"allTrue":["стен"],
"exceptions": List.Flatten([exceptionWords],-1),
"extraTrue":[{"Подзем":100},{"монолит":1}]};

//7 Стены лифтовых шахт;
{"anyTrue":["шахт","стен","лифт"],
"allTrue":[],
"exceptions": List.Flatten([exceptionWords, "сбор"],-1),
"extraTrue":[{"лифтовая шахта из монолитного":10},
{"Подзем":100},{"монолит":1},{"стен":1}]};

//8 Балки;
{"anyTrue":["балки", "балок"],
"allTrue":[],
"exceptions": List.Flatten([exceptionWords],-1),
"extraTrue":[{"Подзем":100},{"монолит":1}]};

//9 Плиты;
{"anyTrue":["плит", "перекрыт"],
"allTrue":[],
"exceptions": List.Flatten([exceptionWords,"Фунд","плит вставок деф", "шахт"],-1),
"extraTrue":[{"Подзем":100},{"монолит":1}]};

//10 Капители;
{"anyTrue":["Капитель", "плит"],
"allTrue":[],
"exceptions": List.Flatten([exceptionWords,"Фунд","плит вставок деф"],-1),
"extraTrue":[{"Подзем":100},{"Капитель":5}, {"плит":1}, {"монолит":1}]};

//11 Фундаменты;
{"anyTrue":["Фунд", "ростверк"],
"allTrue":[],
"exceptions": List.Flatten([exceptionWords, "гидроиз","утепл",
"деформ", "молниезащ", "усилен"],-1),
"extraTrue":[{"монолит":1}]};
//[[], ["Фунд", "плит"], ["Подзем"]];

//12 Лестничные площадки;
{"anyTrue":["лест","Лестнич", "плит", "перекрыт"],
"allTrue":[],
"exceptions": List.Flatten([exceptionWords,"Сбор","Фунд",
"плит вставок деф", "шахт"],-1),
"extraTrue":[{"Подзем":100},{"монолит":1},{"площад":2}]};

//13 Лестничные марши;
{"anyTrue":["лестниц", "лестничных маршей", "Лестничный марш"],
"allTrue":[],
"exceptions": List.Flatten([exceptionWords,"Сбор", "металл", "покрыт"],-1),
"extraTrue":[{"Подзем":100},{"монолит":1}]};

//14 Термовкладыши;
//{"anyTrue":[],
//"allTrue":["термовклад"],
//"exceptions": List.Flatten([exceptionWords],-1),
//"extraTrue":[{"Подзем":100}]};


//15 Колонны;
{"anyTrue":[],
"allTrue":["Колон"],
"exceptions": List.Flatten([exceptionWords, "сталежелезо", "Стал", "метал"],-1),
"extraTrue":[{"Подзем":100},{"монолит":1}]};

//16 Сваи;
{"anyTrue":["свай","сваи","свая"],
"allTrue":[],
"exceptions": List.Flatten([exceptionWords,"составн", "испытан", "Jet",
"бур", "водонепрониц", "вдавл"],-1),
"extraTrue":[{"забив":100},{"основан":1}]};

//17 Рампы;
{"anyTrue":[],
"allTrue":["рамп"],
"exceptions": List.Flatten([exceptionWords],-1),
"extraTrue":[{"Подзем":100},{"монолит":1}]};

//18 Плиты вставки деформационных швов;
{"anyTrue":[],
"allTrue":["плит вставок деф"],
"exceptions": List.Flatten([exceptionWords],-1),
"extraTrue":[{"Подзем":100},{"монолит":1}]};
# ----------------------------------------
code_block_49 = CodeBlock(ac4=code_block_48.out1, ac6=code_block_48.out2, ac7=code_block_48.out3, ac8=code_block_48.out4, ac9=code_block_48.out5, ac10=code_block_48.out6, ac11=code_block_48.out7, ac12=code_block_48.out8, ac13=code_block_48.out9, ac15=code_block_48.out10, ac16=code_block_48.out11, ac17=code_block_48.out12, ac18=code_block_48.out13)
# ---------- code_block_49.designscript (15 lines) ----------
[ac4,

ac6,
ac7,
ac8,
ac9,
ac10,
ac11,
ac12,
ac13,

ac15,
ac16,
ac17,
ac18];
# ----------------------------------------
python_script_3 = Python(IN[0]=components.keys, IN[1]=components.values, IN[2]=code_block_49)  # IronPython2
# ---------- python_script_3.python (84 lines) ----------
# Load the Python Standard and DesignScript Libraries
import sys
import clr
clr.AddReference('ProtoGeometry')
from Autodesk.DesignScript.Geometry import *

# The inputs to this node will be stored as a list in the IN variables.
keys = IN[0]
values = IN[1]
wordsList = IN[2]
belowZero = ["подзем", "ниже"]
myKeys = []
myValues = []
myRating = []
k=0

for words in wordsList:
	
	boolNoKey = True
	myKeysTemp = []
	myValuesTemp = []
	myRatingTemp = []
	ratingMax=0
	for i in xrange(len(values)):
	
		bool1 = any([w.ToLower() in values[i].ToLower() for w in words.get("anyTrue")])
		if len(words.get("anyTrue"))<1:
			bool1=True	
		
		bool2 = all([w.ToLower() in values[i].ToLower() for w in words.get("allTrue")])
		if len(words.get("allTrue"))<1:
			bool2=True
			
		bool3 = any([w.ToLower() in values[i].ToLower() for w in words.get("exceptions")])
		if len(words.get("exceptions"))<1:
			bool3=False
		
		rating=1	
		for w in words.get("extraTrue"):
			if w.keys()[0].ToLower() in values[i].ToLower():
				rating=rating+w.values()[0]	
		#rating=rating+sum([w.values()[0] for w in words.get("extraTrue") if w.keys()[0].ToLower() in values[i].ToLower()]):
		
		if bool1 and bool2 and not bool3 and rating>=ratingMax:
			if ratingMax==0:
				myKeysTemp.append(keys[i])
				myValuesTemp.append(values[i])
			elif rating == ratingMax:
				myKeysTemp.append(keys[i])
				myValuesTemp.append(values[i])
			else:
				myKeysTemp=[keys[i]]
				myValuesTemp=[values[i]]
			boolNoKey = False
			ratingMax = rating
			
	if ratingMax<100:
		for mv in myValuesTemp:
			boolIn = False
			for i in xrange(len(values)):
				if mv == values[i]:
					endIndex = keys[i].rfind(".")
					upperKey=keys[i][0:endIndex]
					for j in xrange(len(keys)):
						if upperKey==keys[j]:
							if any([bz.ToLower() in values[j].ToLower() for bz in belowZero]):
								myKeysTemp=[keys[i]]
								myValuesTemp=[values[i]]
								boolIn=True
								bool1=False
			if boolIn:
				break
				
	if boolNoKey:
		k=k+1
		myKeysTemp.append("No Key "+str(k))
		myValuesTemp.append("No Value "+str(k))
	myKeys.append(myKeysTemp)
	myValues.append(myValuesTemp)

# Place your code below this line

# Assign your output to the OUT variable.
OUT = [myKeys, myValues]
# ----------------------------------------
code_block_50 = CodeBlock(python=python_script_3) { code = List.Flatten(python[0], -1); name = List.Flatten(python[1], -1); }
code_block_51 = CodeBlock(value=code_block_50.code)  # same code as code_block_45
code_block_52 = CodeBlock(assemblyCode_P=code_block_51.out0, assemblyCode_W=code_block_51.out1, assemblyCode_CSH=code_block_51.out2, assemblyCode_Beams=code_block_51.out3, assemblyCode_F=code_block_51.out4, assemblyCode_C=code_block_51.out5, assemblyCode_S=code_block_51.out6, assemblyCode_LA=code_block_51.out7, assemblyCode_STA=code_block_51.out8, assemblyCode_SCO=code_block_51.out9, assemblyCode_PILE=code_block_51.out10, assemblyCode_R=code_block_51.out11, assemblyCode_EJF=code_block_51.out12)
# ---------- code_block_52.designscript (30 lines) ----------
//4 Пилоны;
assemblyCode_P;
//5 Парапеты;
//assemblyCode_PA;
//6 Стены;
assemblyCode_W;
//7 Стены лифтовых шахт;
assemblyCode_CSH;
//8 Балки;
assemblyCode_Beams;
//9 Плиты;
assemblyCode_F;
//10 Капители;
assemblyCode_C;
//11 Фундаменты;
assemblyCode_S;
//12 Лестничные площадки;
assemblyCode_LA;
//13 Лестничные марши;
assemblyCode_STA;
//14 Термовкладыши;
//assemblyCode_HEAT;
//15 Колонны;
assemblyCode_SCO;
//16 Сваи;
assemblyCode_PILE;
//17 Рампы;
assemblyCode_R;
//18 Плиты вставки деформационных швов;
assemblyCode_EJF;
# ----------------------------------------
задаю_параметры_кодификатора_и_2 = Python(IN[0]=code_block_36.BZ, IN[1]=code_block_47.text_FAM_Underground, IN[2]=code_block_47.type, IN[3]=code_block_47.assembly_code, IN[4]=code_block_52.assemblyCode_P, IN[6]=code_block_52.assemblyCode_W, IN[7]=code_block_52.assemblyCode_CSH, IN[8]=code_block_52.assemblyCode_Beams, IN[9]=code_block_52.assemblyCode_F, IN[10]=code_block_52.assemblyCode_C, IN[11]=code_block_52.assemblyCode_S, IN[12]=code_block_52.assemblyCode_LA, IN[13]=code_block_52.assemblyCode_STA, IN[15]=code_block_52.assemblyCode_SCO, IN[16]=code_block_52.assemblyCode_PILE, IN[17]=code_block_52.assemblyCode_R, IN[18]=code_block_52.assemblyCode_EJF)  # "Задаю параметры Кодификатора и FAM_Undeground для элементов ниже нуля"; IronPython2; unwired: IN[5], IN[14]
# ---------- задаю_параметры_кодификатора_и_2.python (175 lines) ----------
import clr

# 1. Revit API
clr.AddReference("RevitAPI")  
from Autodesk.Revit.DB import *  

# 2. Revit Services (для работы с документом)
clr.AddReference("RevitServices")  
from RevitServices.Persistence import DocumentManager  
from RevitServices.Transactions import TransactionManager  

# 3. Dynamo Core (для работы с элементами Dynamo)
clr.AddReference("DSCoreNodes")  
import DSCore  

# 4. Dynamo Revit (для операций, специфичных для Revit)
clr.AddReference("RevitNodes")  
import Revit  

# 5. Преобразование Dynamo ↔ Revit (обязательно!)
clr.ImportExtensions(Revit.Elements)  
clr.ImportExtensions(Revit.GeometryConversion)  

def Warning(warnings, text):
	
	war = "Не найдено описание подходящие для "+text+" в заданном классификаторе."
	if war not in warnings:
		warnings.append(war)
# Получаем текущий документ Revit
doc = DocumentManager.Instance.CurrentDBDocument  
uidoc = DocumentManager.Instance.CurrentUIApplication.ActiveUIDocument  

elements = IN[0]
text_FAM_Undeground = IN[1]
paramType = IN[2]
#Assembly code для Walls
paramAssCode = IN[3]
assemblyCode_P = IN[4] #Пилоны

assemblyCode_W = IN[6] #Стены
assemblyCode_CSH = IN[7] #Стены лифтовых шахт
#Assembly code для Walls и Structural Framings
assemblyCode_Beams = IN[8] #Балки
#Assembly code для Floors
assemblyCode_F = IN[9] #Плиты
assemblyCode_C = IN[10] #Капители
assemblyCode_R = IN[17] #Рампы
assemblyCode_EJF = IN[18] #Плиты вставки деформационных швов 
#Assembly code для Floors и Structural Foundation и Slab Edge
assemblyCode_S = IN[11] #Фундаменты
#Assembly code для Floors и Generic Models
assemblyCode_LA = IN[12] #Лестничные площадки
#Assembly code для Generic Models
assemblyCode_STA = IN[13] #Лестничные марши
assemblyCode_Heat = IN[14] #Термовкладыши
#Assembly code для Structural Columns
assemblyCode_SCO = IN[15] #Колонны
assemblyCode_PILE = IN[16] #Сваи
#Assembly code для Generic Models


newTypes = []
oldTypes = []
warnings = []
wrongTypes = []
for elem in elements:
	boolTypeAssCode = True
	boolTypeUndeground = True
	try:
		elem.SetParameterByName("FAM_Underground", text_FAM_Undeground)
		boolTypeUndeground = False
	except: 1
	try:
		elem.SetParameterByName(paramAssCode, "Нет такого типа")
		boolTypeAssCode = False
	except: 1
	
	type = elem.GetParameterValueByName(paramType)
	categoryName = elem.GetCategory.Name
	oldTypes.append(type.Name)

	boolBeam = False
	boolSlab = "Foundations" in categoryName  or "Slab" in categoryName

	boolLanding = False
	boolSTA = False
	boolSCO = False
	boolPILE = False
	boolHEAT = False
	
	if hasattr(type, 'Family'):
		boolBeam = "S_FRA_" in str(type.Family) and not "S_FRA_STE" in str(type.Family)
		boolSlab = "_Pit_" in str(type.Family)
		boolLanding = "Landing" in str(type.Family)
		boolSCO = "S_SCO_RCO_Column" in str(type.Family) or "S_SCO_Column" in str(type.Family)
		boolPILE = "S_SCO_RCO_Pile"in str(type.Family) or "S_SCO_Pile"in str(type.Family)
		boolSTA = "Stair" in str(type.Family) and not boolLanding
		boolHEAT = "_HeatInsulating" in str(type.Family)

		
	boolNotRename = boolSlab or boolPILE
	newName = ""	
	newType = elem
	if boolTypeAssCode:
		if not type.Name.endswith("_BGL") and not boolNotRename:
			newName = type.Name +"_BGL"		
			try:
				newType = type.Duplicate(newName)
			except:
				try:
					newType = type.ByName(newName)
				except:
					newType = type.ByFamilyAndName(type.Family, newName)
		else:
			newType = type
		elem.SetParameterByName(paramType, newType)
			
	if newType.Name not in newTypes or newType == elem:
		try:
			newType.SetParameterByName("FAM_Underground", text_FAM_Undeground)
		except:
			elem.SetParameterByName("FAM_Underground", text_FAM_Undeground)	
		
		if "_P_" in newType.Name:
			try: newType.SetParameterByName(paramAssCode,assemblyCode_P)
			except: Warning(warnings, "пилонов подземной части")
		elif "_W_" in newType.Name:
			try: newType.SetParameterByName(paramAssCode,assemblyCode_W)
			except: Warning(warnings, "стен подземной части")
		elif "_B_" in newType.Name or boolBeam:
			try: newType.SetParameterByName(paramAssCode,assemblyCode_Beams)
			except: Warning(warnings, "балок подземной части")
		elif "_CSH_" in newType.Name:
			try: newType.SetParameterByName(paramAssCode,assemblyCode_CSH)
			except: Warning(warnings, "стен лифтовых шахт подземной части")
				
		elif "_F_" in newType.Name:
			try: newType.SetParameterByName(paramAssCode,assemblyCode_F)
			except: Warning(warnings, "плит перекрытий подземной части")
		elif "_C_" in newType.Name:
			try: newType.SetParameterByName(paramAssCode,assemblyCode_C)
			except: Warning(warnings, "капителей подземной части")
		elif "_R_" in newType.Name:
			try: newType.SetParameterByName(paramAssCode,assemblyCode_R)
			except: Warning(warnings, "рамп подземной части")
		elif "_EJF_" in newType.Name:
			try: newType.SetParameterByName(paramAssCode,assemblyCode_EJF)
			except: Warning(warnings, "плит вставок деформационных швов подземной части")
		elif "_S_" in newType.Name or boolSlab:
			try: newType.SetParameterByName(paramAssCode,assemblyCode_S)
			except: Warning(warnings, "фундаментных плит")
		elif "_LA_" in newType.Name or boolLanding:
			try: newType.SetParameterByName(paramAssCode,assemblyCode_LA)
			except: Warning(warnings, "лестничных площадок из монолитного жб подземмной части")
				
		elif boolSTA:
			try: newType.SetParameterByName(paramAssCode,assemblyCode_STA)
			except: Warning(warnings, "лестниц из монолитного жб подземной части")
		elif boolHEAT:
			try: newType.SetParameterByName(paramAssCode,assemblyCode_HEAT)
			except: Warning(warnings, "термовкладышей подземной части")
				
		elif boolSCO:
			try: newType.SetParameterByName(paramAssCode,assemblyCode_SCO)
			except: Warning(warnings, "колонн подземной части")

		elif boolPILE:
			try: newType.SetParameterByName(paramAssCode,assemblyCode_PILE)
			except: Warning(warnings, "свай")	
			
		else:
			wrongTypes.append(newType)
 
	newTypes.append(newType.Name)
OUT = [warnings, elements, wrongTypes]
# ----------------------------------------
code_block_53 = CodeBlock(pythonUp=задаю_параметры_кодификатора_и, pythonDown=задаю_параметры_кодификатора_и_2) { AZCodes = List.Flatten(pythonUp[0], -1); BZCodes = List.Flatten(pythonDown[0], -1); }

# group (continued): Предупреждение
ошибка_стена_пересекает_более = CodeBlock(notRepairedWalls1=исключаю_указанные_id_элементов.notRepairedWalls, wallsWrong=code_block_18.wallsWrong, notRepairedCollumnss1=исключаю_указанные_id_элементов.notRepairedColumns, collumnsWrong=code_block_19.collumnsWrong, inGroups=filterByBoolMask.in, AZCodes=code_block_53.AZCodes, BZCodes=code_block_53.BZCodes)  # "Ошибка: Стена пересекает более одной плиты нуля"
# ---------- ошибка_стена_пересекает_более.designscript (52 lines) ----------
notRepairedWalls=List.Flatten([notRepairedWalls1, wallsWrong],-1);
notRepairedColumns=List.Flatten([notRepairedCollumnss1, collumnsWrong],-1);
idWalls=List.Flatten(notRepairedWalls.Id);
idInGroups=List.Flatten(inGroups.Id);
idLWalls=String.Join(", ",ToString([null,idWalls][List.IsEmpty(idWalls)?0:1]<1>));
idColumns=List.Flatten(notRepairedColumns.Id);
idLColumns=String.Join(", ",ToString([null,idColumns][List.IsEmpty(idColumns)?0:1]<1>));
idInGroupsT=String.Join(", ",ToString([null,idInGroups][List.IsEmpty(idInGroups)?0:1]<1>));

wa1={"Code":"0001",
"Type":"Warning",
"Status":List.Count(notRepairedWalls)>0,
"Name":"Стена рассекается плитой нуля или не рассекается ни одной плитой в данном уровне.",
"Solution":"Самостоятельно проверьте правильность наименование данных стен. ID стен:
"+idLWalls+"
Данные стены пересекают плиты на уровне разделения ниже и выше нуля, либо не пересекают ни одну из таких плит.
Если после самостоятельной проверки у стен был верно заполнен параметр FAM_Underground, то запустите динамо заного, введя ID отработтаных стен в указанное поле ниже.
Элементы можно быстро найти воспользовавшись кнопкой Select by ID (Выбрать по коду) на вкладке Manage (Управление)"};

wa2={"Code":"0002",
"Type":"Warning",
"Status":List.Count(notRepairedColumns)>0,
"Name":"Колонна рассекается плитой нуля или не рассекается ни одной плитой в данном уровне.",
"Solution":"Самостоятельно проверьте правильность наименование данных колонн. ID колонн:
"+idLColumns+"
Данные колонны пересекают плиты на уровне разделения ниже и выше нуля, либо не пересекают ни одну из таких плит.
Если после самостоятельной проверки у колонн был верно заполнен параметр FAM_Underground, то запустите динамо заного, введя ID отработтаных колонн в указанное поле ниже.
Элементы можно быстро найти воспользовавшись кнопкой Select by ID (Выбрать по коду) на вкладке Manage (Управление)"};

wa3={"Code":"0003",
"Type":"Warning",
"Status":List.Count(AZCodes)>0,
"Name":AZCodes,
"Solution": "Обратитесь к разработчику скрипта для решения проблемы."
};

wa4={"Code":"0004",
"Type":"Warning",
"Status":List.Count(BZCodes)>0,
"Name":BZCodes,
"Solution": "Обратитесь к разработчику скрипта для решения проблемы."
};

wa5={"Code":"0005",
"Type":"Warning",
"Status":List.Count(inGroups)>0,
"Name":"Данные элементы находятся в группах, изменения их типразмеров или параметров приведёт к разгруппировки группы",
"Solution": "Самостоятельно отредактируйте типоразмеры данных элементов:
"+idInGroupsT
};

[wa1, wa2, wa3, wa4, wa5];
# ----------------------------------------
code_block_54 = CodeBlock(rep=ошибка_стена_пересекает_более.out13)
# ---------- code_block_54.designscript (4 lines) ----------
wa=List.FilterByBoolMask(rep,rep["Type"]=="Warning"&&rep["Status"])["in"];
Titl="Завершено "+(wa[0]==null?"без ошибок.":"с предупреждениями:\n");
WaText="Предупреждение: "+wa["Name"]+"\nРешение: "+wa["Solution"]+"\n";
String.Join("\n", List.Clean(List.Flatten([Titl,WaText]),false));
# ----------------------------------------
отчет = Watch(code_block_54.out3)

code_block_55 = CodeBlock { ф; }  # unwired: ф

# group: Если надо раскидать по имени типа
если_надо_рскидать_по_имени_типа = CodeBlock()  # frozen; unwired: AssCode, typeBIN, elementCodeBZ, wrongTypeNames, wrongElements, rightT, uniqueWTN, newT
# ---------- если_надо_рскидать_по_имени_типа.designscript (20 lines) ----------
AssCode;
typeBIN;
elementCodeBZ;
wrongTypeNames;
wrongElements;
rightT;
uniqueWTN;
newT;

indexes = List.AllIndicesOf(wrongTypeNames, uniqueWTN);
elements = List.GetItemAtIndex(wrongElements, indexes);
elementsNewRightNames = Element.SetParameterByName(elements, typeBIN, newT);

allRightT=List.Join([rightT, newT]);
sort = List.SortByKey(allRightT, WallType.Name(allRightT));
sortedByNameT = List.UniqueItems(Dictionary.ValueAtKey(sort, "sortedList"));

zero = List.IndexOf(sortedByNameT, sortedByNameT)>8?"":"0";
text = elementCodeBZ+"."+zero+(List.IndexOf(sortedByNameT,sortedByNameT)+1);
Element.SetParameterByName(sortedByNameT, AssCode, text);
# ----------------------------------------

code_block_56 = CodeBlock()  # frozen
# ---------- code_block_56.designscript (28 lines) ----------
//4 Пилоны;
"Устройство пилонов из монолитного ж/б";
//5 Парапеты;
"Устройство монолитных ж/б парапетов";
//6 Стены;
"Устройство стен из монолитного ж/б";
//7 Стены лифтовых шахт;
"Устройство лифтовых шахт из монолитного ж/б";
//8 Балки;
"Устройство балок из монолитного ж/б";
//9 Плиты;
"Устройство плит перекрытия из монолитного ж/б";
//10 Капители;
"Устройство плит перекрытия из монолитного ж/б";
//11 Фундаменты;
"Устройство фундаментной плиты";
//12 Лестничные площадки;
"Устройство лестниц, площадок из монолитного ж/б";
//13 Лестничные марши;
"Устройство лестниц, площадок из монолитного ж/б";
//14 Термовкладыши;
"Устройство термовкладышей ж/б конструкций";
//15 Колонны;
"Устройство колонн из монолитного ж/б";
//16 Рампы;
"Устройство рамп, пандусов из монолитного ж/б";
//17 Плиты вставки деформационных швов;
"Устройство плит вставок деформационных швов из монолитного ж/б";
# ----------------------------------------
code_block_57 = CodeBlock(ac4=code_block_56.out0, ac5=code_block_56.out1, ac6=code_block_56.out2, ac7=code_block_56.out3, ac8=code_block_56.out4, ac9=code_block_56.out5, ac10=code_block_56.out6, ac11=code_block_56.out7, ac12=code_block_56.out8, ac13=code_block_56.out9, ac14=code_block_56.out10, ac15=code_block_56.out11, ac16=code_block_56.out12, ac17=code_block_56.out13)
# ---------- code_block_57.designscript (14 lines) ----------
[ac4,
ac5,
ac6,
ac7,
ac8,
ac9,
ac10,
ac11,
ac12,
ac13,
ac14,
ac15,
ac16,
ac17];
# ----------------------------------------
code_block_58 = CodeBlock()  # frozen
# ---------- code_block_58.designscript (30 lines) ----------
//4 Пилоны;
"Устройство пилонов подземной части из монолитного ж/б";
//5 Парапеты;
"Устройство монолитных ж/б парапетов";
//6 Стены;
"Устройство стен подземной части из монолитного ж/б";
//7 Стены лифтовых шахт;
"Устройство лифтовых шахт подземной части из монолитного ж/б";
//8 Балки;
"Устройство балок подземной части из монолитного ж/б";
//9 Плиты;
"Устройство плит перекрытия подземной части из монолитного ж/б";
//10 Капители;
"Устройство плит перекрытия подземной части из монолитного ж/б";
//11 Фундаменты;
"Устройство фундаментной плиты";
//12 Лестничные площадки;
"Устройство лестниц, площадок подземной части из монолитного ж/б";
//13 Лестничные марши;
"Устройство лестниц, площадок подземной части из монолитного ж/б";
//14 Термовкладыши;
"Устройство термовкладышей ж/б конструкций";
//15 Колонны;
"Устройство колонн подземной части из монолитного ж/б";
//16 Сваи;
"Устройство свайного основания";
//17 Рампы;
"Устройство рамп, пандусов подземной части из монолитного ж/б";
//18 Плиты вставки деформационных швов;
"Устройство плит вставок деформационных швов подземной части из монолитного ж/б";
# ----------------------------------------
code_block_59 = CodeBlock(ac4=code_block_58.out0, ac5=code_block_58.out1, ac6=code_block_58.out2, ac7=code_block_58.out3, ac8=code_block_58.out4, ac9=code_block_58.out5, ac10=code_block_58.out6, ac11=code_block_58.out7, ac12=code_block_58.out8, ac13=code_block_58.out9, ac14=code_block_58.out10, ac15=code_block_58.out11, ac16=code_block_58.out12, ac17=code_block_58.out13, ac18=code_block_58.out14)
# ---------- code_block_59.designscript (15 lines) ----------
[ac4,
ac5,
ac6,
ac7,
ac8,
ac9,
ac10,
ac11,
ac12,
ac13,
ac14,
ac15,
ac16,
ac17,
ac18];
# ----------------------------------------
code_block_60 = CodeBlock(ф=code_block_45.out0) { ф; }
code_block_61 = CodeBlock(ф=code_block_46.assemblyCode_P) { ф; }

# group: Импортирую кодификатор из указанного эксель (уникально для каждого эксель файла)
file_path = Filename("..\..\Классификатор ГЛАВСТРОЙ от марта 2023г.xlsx")
file_from_path_2 = FileObject(path=file_path)
code_block_62 = CodeBlock { "TDSheet"; }
code_block_63 = CodeBlock { false; }
importExcel = Data.ImportExcel(file=file_from_path_2, sheetName=code_block_62, showExcel=code_block_63)
transpose_2 = List.Transpose(lists=importExcel)
code_block_64 = CodeBlock(lst=transpose_2) { lst; code = Get.ValueAtIndex(lst, 1); name = Get.ValueAtIndex(lst, 0); }

python_script_4 = Python(IN[0]=components.keys, IN[1]=components.values, IN[2]=code_block_43)  # IronPython2; frozen
# ---------- python_script_4.python (65 lines) ----------
# Load the Python Standard and DesignScript Libraries
import sys
import clr
clr.AddReference('ProtoGeometry')
from Autodesk.DesignScript.Geometry import *

# The inputs to this node will be stored as a list in the IN variables.
keys = IN[0]
values = IN[1]
wordsList = IN[2]
myKeys = []
myValues = []
myRating = []
k=0

for words in wordsList:
	
	boolNoKey = True
	myKeysTemp = []
	myValuesTemp = []
	myRatingTemp = []
	ratingMax=0
	for i in xrange(len(values)):
	
		bool1 = any([w.ToLower() in values[i].ToLower() for w in words.get("anyTrue")])
		if len(words.get("anyTrue"))<1:
			bool1=True	
		
		bool2 = all([w.ToLower() in values[i].ToLower() for w in words.get("allTrue")])
		if len(words.get("allTrue"))<1:
			bool2=True
			
		bool3 = any([w.ToLower() in values[i].ToLower() for w in words.get("exceptions")])
		if len(words.get("exceptions"))<1:
			bool3=False
		
		rating=1	
		for w in words.get("extraTrue"):
			if w.keys()[0].ToLower() in values[i].ToLower():
				rating=rating+w.values()[0]	
		#rating=rating+sum([w.values()[0] for w in words.get("extraTrue") if w.keys()[0].ToLower() in values[i].ToLower()]):
		
		if bool1 and bool2 and not bool3 and rating>=ratingMax:
			if ratingMax==0:
				myKeysTemp.append(keys[i])
				myValuesTemp.append(values[i])
			elif rating == ratingMax:
				myKeysTemp.append(keys[i])
				myValuesTemp.append(values[i])
			else:
				myKeysTemp=[keys[i]]
				myValuesTemp=[values[i]]
			boolNoKey = False
			ratingMax = rating
	if boolNoKey:
		k=k+1
		myKeysTemp.append("No Key "+str(k))
		myValuesTemp.append("No Value "+str(k))
	myKeys.append(myKeysTemp)
	myValues.append(myValuesTemp)

# Place your code below this line

# Assign your output to the OUT variable.
OUT = [myKeys, myValues]
# ----------------------------------------
code_block_65 = CodeBlock(python=python_script_4) { code = python[0]; name = python[1]; }
python_script_5 = Python(IN[0]=components.keys, IN[1]=components.values, IN[2]=code_block_65.name)  # IronPython2
# ---------- python_script_5.python (48 lines) ----------
# Load the Python Standard and DesignScript Libraries
import sys
import clr
clr.AddReference('ProtoGeometry')
from Autodesk.DesignScript.Geometry import *

# The inputs to this node will be stored as a list in the IN variables.
keys = IN[0]
values = IN[1]
myValues = IN[2]
myKeys =[]
myValuesNew = []
belowZero = ["подзем", "ниже"]
for myValue in myValues:
	bool1=True
	upperKey=""
	if len(myValue)<2:
		for i in xrange(len(values)):
			if myValue[0] == values[i]:
				myKeys.append(keys[i])
				myValuesNew.append(values[i])
				bool1=False
	else:

		for mv in myValue:
			boolIn = False
			for i in xrange(len(values)):
				if mv == values[i]:
					endIndex = keys[i].rfind(".")
					upperKey=keys[i][0:endIndex]
					for j in xrange(len(keys)):
						if upperKey==keys[j]:
							if any([bz.ToLower() in values[j].ToLower() for bz in belowZero]):
								myKeys.append(keys[i])
								myValuesNew.append(values[i])
								boolIn=True
								bool1=False
			if boolIn:
				break
	if bool1:
		myKeys.append("No Code")
		myValuesNew.append("No Code")
		
	
# Place your code below this line

# Assign your output to the OUT variable.
OUT = [myKeys,myValuesNew]
# ----------------------------------------
python_script_6 = Python(IN[0]=components.keys, IN[1]=components.values, IN[2]=code_block_43)  # IronPython2; frozen; same code as python_script_4
code_block_66 = CodeBlock(python=python_script_6) { code = python[0]; name = python[1]; }
python_script_7 = Python(IN[0]=components.keys, IN[1]=components.values, IN[2]=code_block_66.name)  # IronPython2; same code as python_script_5
code_block_67 = CodeBlock(python=python_script_7) { code = python[0]; name = python[1]; }
python_script_8 = Python(IN[0]=components.values)  # IronPython2; frozen; unwired: IN[1]
# ---------- python_script_8.python (33 lines) ----------
# Load the Python Standard and DesignScript Libraries
import sys
import clr
clr.AddReference('ProtoGeometry')
from Autodesk.DesignScript.Geometry import *

# The inputs to this node will be stored as a list in the IN variables.
keys = IN[0]
wordsList = IN[1]
keyByWords = []
for words in wordsList:
	boolNoKey = True
	keyByWords1 = []
	for key in keys:
		bool1 = any([w.ToLower() in key.ToLower() for w in words[0]])
		if len(words[0])<1:
			bool1=True
		bool2 = all([w.ToLower() in key.ToLower() for w in words[1]])
		if len(words[1])<1:
			bool2=True
		bool3 = any([w.ToLower() in key.ToLower() for w in words[2]])
		if len(words[2])<1:
			bool3=False
		if bool1 and bool2 and not bool3:
			keyByWords1.append(key)
			boolNoKey = False
	if boolNoKey:
		keyByWords1.append("!!! Нет такого кода")
	keyByWords.append(keyByWords1)
# Place your code below this line

# Assign your output to the OUT variable.
OUT = keyByWords
# ----------------------------------------
python_script_9 = Python(IN[0]=components.keys, IN[1]=components.values, IN[2]=python_script_8)  # IronPython2
# ---------- python_script_9.python (48 lines) ----------
# Load the Python Standard and DesignScript Libraries
import sys
import clr
clr.AddReference('ProtoGeometry')
from Autodesk.DesignScript.Geometry import *

# The inputs to this node will be stored as a list in the IN variables.
keys = IN[0]
values = IN[1]
myValues = IN[2]
myKeys =[]
myValuesNew = []
belowZero = ["подзем", "ниже"]
for myValue in myValues:
	bool1=True
	upperKey=""
	if len(myValue)<2:
		for i in xrange(len(values)):
			if myValue[0] == values[i]:
				myKeys.append(keys[i])
				myValuesNew.append(values[i])
				bool1=False
	else:

		for mv in myValue:
			boolIn = False
			for i in xrange(len(values)):
				if mv == values[i]:
					endIndex = keys[i].rfind(".")
					upperKey=keys[i][0:endIndex]
					for j in xrange(len(keys)):
						if upperKey==keys[j]:
							if not any([bz.ToLower() in values[j].ToLower() for bz in belowZero]):
								myKeys.append(keys[i])
								myValuesNew.append(values[i])
								boolIn=True
								bool1=False
			if boolIn:
				break
	if bool1:
		myKeys.append("No Code")
		myValuesNew.append("No Code")
		
	
# Place your code below this line

# Assign your output to the OUT variable.
OUT = [myKeys,myValuesNew]
# ----------------------------------------
code_block_68 = CodeBlock(python=python_script_9) { code = python[0]; name = python[1]; }
code_block_69 = CodeBlock(code1=code_block_67.code, code2=code_block_68.code, name1=code_block_67.name, name2=code_block_68.name)
# ---------- code_block_69.designscript (2 lines) ----------
code = code1 == "No Code" && code2 =="No Code"? "No Code": code1 == "No Code"? code2: code1;
name = name1 == "No Code" && name2 =="No Code"? "No Code": name1 == "No Code"? name2: name1;
# ----------------------------------------
python_script_10 = Python(IN[0]=components.keys, IN[1]=components.values)  # IronPython2; frozen; unwired: IN[2]
# ---------- python_script_10.python (41 lines) ----------
# Load the Python Standard and DesignScript Libraries
import sys
import clr
clr.AddReference('ProtoGeometry')
from Autodesk.DesignScript.Geometry import *

# The inputs to this node will be stored as a list in the IN variables.
keys = IN[0]
values = IN[1]
wordsList = IN[2]
myKeys = []
myValues = []
k=0
for words in wordsList:
	boolNoKey = True
	myKeysTemp = []
	myValuesTemp = []
	for i in xrange(len(values)):
		bool1 = any([w.ToLower() in values[i].ToLower() for w in words[0]])
		if len(words[0])<1:
			bool1=True
		bool2 = all([w.ToLower() in values[i].ToLower() for w in words[1]])
		if len(words[1])<1:
			bool2=True
		bool3 = any([w.ToLower() in values[i].ToLower() for w in words[2]])
		if len(words[2])<1:
			bool3=False
		if bool1 and bool2 and not bool3:
			myKeysTemp.append(keys[i])
			myValuesTemp.append(values[i])
			boolNoKey = False
	if boolNoKey:
		k=k+1
		myKeysTemp.append("No Key "+str(k))
		myValuesTemp.append("No Value "+str(k))
	myKeys.append(myKeysTemp)
	myValues.append(myValuesTemp)
# Place your code below this line

# Assign your output to the OUT variable.
OUT = [myKeys, myValues]
# ----------------------------------------
python_script_11 = Python(IN[0]=components.keys, IN[1]=components.values, IN[2]=code_block_49)  # IronPython2; same code as python_script_4
code_block_70 = CodeBlock(a=исключаю_указанные_id_элементов.notRepairedWalls) { a; }
code_block_71 = CodeBlock(a=исключаю_указанные_id_элементов.repairedWalls) { a; }
code_block_72 = CodeBlock(a=исключаю_указанные_id_элементов.notRepairedColumns) { a; }
code_block_73 = CodeBlock(a=исключаю_указанные_id_элементов.repairedColumns) { a; }
code_block_74 = CodeBlock(a=code_block_32.stairsAndLandingsAboveZero) { a; }
code_block_75 = CodeBlock(a=code_block_32.stairsAndLandingsBelowZero) { a; }
code_block_76 = CodeBlock(a=code_block_30.stairsCuboid) { a; }
code_block_77 = CodeBlock(a=code_block_30.sort) { a; }
code_block_78 = CodeBlock(a=code_block_30.sortedPlanes) { a; }
code_block_79 = CodeBlock(a=code_block_30.fPlaneHighest) { a; }
code_block_80 = CodeBlock(a=code_block_30.splitedGeoms) { a; }
code_block_81 = CodeBlock(a=code_block_30.bool1) { a; }
code_block_82 = CodeBlock(a=code_block_30.filter1) { a; }
code_block_83 = CodeBlock(a=code_block_30.filter2) { a; }
code_block_84 = CodeBlock(a=code_block_30.stairsToInspectFurther) { a; }
code_block_85 = CodeBlock(a=code_block_30.stairsToInspectSplitedGeoms) { a; }
code_block_86 = CodeBlock(a=code_block_30.stairsBelowZero1) { a; }
code_block_87 = CodeBlock(a=code_block_30.zCuboid) { a; }
code_block_88 = CodeBlock(a=code_block_30.sorting) { a; }
code_block_89 = CodeBlock(a=code_block_30.sortedByZGeoms) { a; }
code_block_90 = CodeBlock(a=code_block_30.bool2) { a; }
code_block_91 = CodeBlock(a=code_block_30.filter3) { a; }
code_block_92 = CodeBlock(a=code_block_30.stairsAboveZero2) { a; }
code_block_93 = CodeBlock(a=code_block_30.stairsBelowZero2) { a; }
code_block_94 = CodeBlock(a=code_block_30.stairsAndLandingsAboveZero) { a; }
code_block_95 = CodeBlock(a=code_block_30.stairsAndLandingsBelowZero) { a; }
code_block_96 = CodeBlock(a=code_block_30.stairsAboveZero1) { a; }
code_block_97 = CodeBlock(a=code_block_52.assemblyCode_PILE) { a; }
code_block_98 = CodeBlock(value=code_block_50.name)  # same code as code_block_45
code_block_99 = CodeBlock(a=code_block_98.out9) { a; }
code_block_100 = CodeBlock { a; }  # unwired: a
code_block_101 = CodeBlock(a=разделяю_стены_на_выше_и_ниже.wallsToInspectGeo) { a; }
code_block_102 = CodeBlock(a=разделяю_стены_на_выше_и_ниже.pMin) { a; }
code_block_103 = CodeBlock(a=преобразовываю_плиты_в.out12) { a; }
code_block_104 = CodeBlock(a=разделяю_стены_на_выше_и_ниже.intersectionGeo) { a; }
code_block_105 = CodeBlock(a=разделяю_стены_на_выше_и_ниже.intersectionGeoClean) { a; }
code_block_106 = CodeBlock(a=разделяю_стены_на_выше_и_ниже.point1) { a; }
code_block_107 = CodeBlock(a=разделяю_стены_на_выше_и_ниже.plane1) { a; }
code_block_108 = CodeBlock(a=разделяю_стены_на_выше_и_ниже.boolBB) { a; }
code_block_109 = CodeBlock(a=разделяю_стены_на_выше_и_ниже.bool3) { a; }
code_block_110 = CodeBlock(a=разделяю_стены_на_выше_и_ниже.bool4) { a; }
code_block_111 = CodeBlock(a=разделяю_стены_на_выше_и_ниже.wallsToInspectFurtherBL) { a; }
code_block_112 = CodeBlock(a=разделяю_стены_на_выше_и_ниже.wallsToInspectFurtherTL) { a; }
code_block_113 = CodeBlock(a=разделяю_стены_на_выше_и_ниже.wallsToInspectFurther) { a; }
code_block_114 = CodeBlock(ф=разделяю_стены_на_выше_и_ниже.wallsToInspect) { ф; }
code_block_115 = CodeBlock(ф=разделяю_стены_на_выше_и_ниже.pMax) { ф; }
code_block_116 = CodeBlock(ф=разделяю_стены_на_выше_и_ниже.wallsBLGreater1) { ф; }
code_block_117 = CodeBlock(a=code_block_10.wallGeo) { a; }
code_block_118 = CodeBlock(a=code_block_10.bool1) { a; }
code_block_119 = CodeBlock(a=code_block_10.index) { a; }
code_block_120 = CodeBlock(a=code_block_10.floorSurfacesList) { a; }
code_block_121 = CodeBlock(a=code_block_10.z) { a; }
code_block_122 = CodeBlock(a=code_block_10.boolTopMORE) { a; }
code_block_123 = CodeBlock(ф=разделяю_стены_на_выше_и_ниже.filterWalls0) { ф; }
code_block_124 = CodeBlock(ф=разделяю_стены_на_выше_и_ниже.wallsIntercestedGreater1) { ф; }
code_block_125 = CodeBlock(a=code_block_46.assemblyCode_Beams) { a; }
code_block_126 = CodeBlock(a=ошибка_стена_пересекает_более.idInGroups) { a; }
